# Grasshopper definition 20260603 ELE axis and dimension.gh (Grasshopper 1.0.8)

# ---- group: 天正风格立面剖面标注
层数 = Slider(4, range=1..20)
层高_mm = Slider(4000, range=2000..6000)
立面宽度_mm = Slider(12852, range=2000..50000)
标注延伸_mm = Slider(300, range=0..3000)
尺寸线偏移_mm = Slider(1180, range=500..8000)
标高线间距_mm = Slider(900, range=500..8000)
楼层文字偏移_mm = Slider(1200, range=500..8000)
标高字高_mm = Slider(250, range=100..1000)
楼层字高_mm = Slider(300, range=100..1000)
tianzheng_elevation_annotation = CSharpScript(
    floorCount=层数,
    floorHeight=层高_mm,
    totalWidth=立面宽度_mm,
    extensionLen=标注延伸_mm,
    dimGap=尺寸线偏移_mm,
    levelGap=标高线间距_mm,
    floorTextGap=楼层文字偏移_mm,
    levelTextHeight=标高字高_mm,
    floorTextHeight=楼层字高_mm)  # -> out, a, b, c, d, e, f, g
# ---------- tianzheng_elevation_annotation: C# ----------
// Grasshopper Script Instance
#region Usings
using System;
using System.Linq;
using System.Collections;
using System.Collections.Generic;
using System.Drawing;

using Rhino;
using Rhino.Geometry;

using Grasshopper;
using Grasshopper.Kernel;
using Grasshopper.Kernel.Data;
using Grasshopper.Kernel.Types;
#endregion

public class Script_Instance : GH_ScriptInstance
{
    #region Notes
    /* 
      Members:
        RhinoDoc RhinoDocument
        GH_Document GrasshopperDocument
        IGH_Component Component
        int Iteration

      Methods (Virtual & overridable):
        Print(string text)
        Print(string format, params object[] args)
        Reflect(object obj)
        Reflect(object obj, string method_name)
    */
    #endregion

    private void RunScript(
		object floorCount,
		object floorHeight,
		object totalWidth,
		object extensionLen,
		object dimGap,
		object levelGap,
		object floorTextGap,
		object levelTextHeight,
		object floorTextHeight,
		ref object a,
		ref object b,
		ref object c,
		ref object d,
		ref object e,
		ref object f,
		ref object g)
    {
    int floorCountRaw = 1;
    double floorHeightRaw = 4000.0;
    double totalWidthRaw = 12000.0;
    double extensionLenRaw = 300.0;
    double dimGapRaw = 1200.0;
    double levelGapRaw = 900.0;
    double floorTextGapRaw = 1200.0;
    double levelTextHeightRaw = 250.0;
    double floorTextHeightRaw = 300.0;
    
    if (floorCount != null) int.TryParse(floorCount.ToString(), out floorCountRaw);
    if (floorHeight != null) double.TryParse(floorHeight.ToString(), out floorHeightRaw);
    if (totalWidth != null) double.TryParse(totalWidth.ToString(), out totalWidthRaw);
    if (extensionLen != null) double.TryParse(extensionLen.ToString(), out extensionLenRaw);
    if (dimGap != null) double.TryParse(dimGap.ToString(), out dimGapRaw);
    if (levelGap != null) double.TryParse(levelGap.ToString(), out levelGapRaw);
    if (floorTextGap != null) double.TryParse(floorTextGap.ToString(), out floorTextGapRaw);
    if (levelTextHeight != null) double.TryParse(levelTextHeight.ToString(), out levelTextHeightRaw);
    if (floorTextHeight != null) double.TryParse(floorTextHeight.ToString(), out floorTextHeightRaw);
    
    int floorCountSafe = Math.Max(1, floorCountRaw);
    double floorHeightSafe = Math.Max(100.0, floorHeightRaw);
    double totalWidthSafe = Math.Max(1000.0, totalWidthRaw);
    double extLenSafe = Math.Max(0.0, extensionLenRaw);
    double dimGapSafe = Math.Max(200.0, dimGapRaw);
    double levelGapSafe = Math.Max(200.0, levelGapRaw);
    double floorTextGapSafe = Math.Max(200.0, floorTextGapRaw);
    double levelTextH = Math.Max(50.0, levelTextHeightRaw);
    double floorTextHSafe = Math.Max(50.0, floorTextHeightRaw);
    
    var redLines = new List<LineCurve>();
    var greenLines = new List<LineCurve>();
    var triangles = new List<PolylineCurve>();
    var levelTexts = new List<TextEntity>();
    var floorTexts = new List<TextEntity>();
    var report = new List<string>();
    
    double totalHeight = floorCountSafe * floorHeightSafe;
    double dimX = totalWidthSafe + dimGapSafe;
    double levelX = dimX + levelGapSafe;
    
    double textInset = Math.Max(220.0, floorTextHSafe * 0.9);
    double floorTextOffsetSafe = Math.Max(floorTextGapSafe, floorTextHSafe * 2.2);
    double levelLineLen = Math.Max(900.0, levelTextH * 4.2);
    double triWidth = Math.Max(260.0, levelTextH * 2.0);
    double triHeight = Math.Max(180.0, levelTextH * 1.05);
    double triStartX = levelX + Math.Max(160.0, levelTextH * 0.35);
    double levelTextOffsetY = Math.Max(levelTextH * 0.7, 130.0);
    double levelTextOffsetX = Math.Max(levelTextH * 1.45, 320.0);
    double slashHalf = Math.Max(170.0, floorTextHSafe * 0.7);
    double slashRise = slashHalf * 0.78;
    double levelSlashHalf = slashHalf * 1.1;
    double levelSlashRise = slashRise * 1.1;
    double levelLineY = triHeight;
    double levelLineStart = triStartX;
    double lowerLineLeft = Math.Max(180.0, triWidth * 0.9);
    double lowerLineRight = triWidth * 0.55;
    double axisClearGap = Math.Max(160.0, floorTextHSafe * 0.8);
    double dimLineStartX = totalWidthSafe + axisClearGap;
    double dimLineEndX = dimX + extLenSafe;
    
    greenLines.Add(new LineCurve(new Point3d(dimX, 0, 0), new Point3d(dimX, totalHeight, 0)));
    greenLines.Add(new LineCurve(new Point3d(levelX, 0, 0), new Point3d(levelX, totalHeight, 0)));
    
    for (int i = 0; i <= floorCountSafe; i++)
    {
      double y = i * floorHeightSafe;
      redLines.Add(new LineCurve(new Point3d(0, y, 0), new Point3d(totalWidthSafe, y, 0)));
      greenLines.Add(new LineCurve(new Point3d(dimLineStartX, y, 0), new Point3d(dimLineEndX, y, 0)));
      greenLines.Add(new LineCurve(new Point3d(dimX - slashHalf, y - slashRise, 0), new Point3d(dimX + slashHalf, y + slashRise, 0)));
      greenLines.Add(new LineCurve(new Point3d(levelX - levelSlashHalf, y - levelSlashRise, 0), new Point3d(levelX + levelSlashHalf, y + levelSlashRise, 0)));
      greenLines.Add(new LineCurve(new Point3d(levelLineStart, y + levelLineY, 0), new Point3d(triStartX + levelLineLen, y + levelLineY, 0)));
      greenLines.Add(new LineCurve(new Point3d(triStartX - lowerLineLeft, y, 0), new Point3d(triStartX + lowerLineRight, y, 0)));
    
      var triPts = new List<Point3d>();
      triPts.Add(new Point3d(triStartX, y + triHeight, 0));
      triPts.Add(new Point3d(triStartX + triWidth, y + triHeight, 0));
      triPts.Add(new Point3d(triStartX + triWidth * 0.5, y, 0));
      triPts.Add(new Point3d(triStartX, y + triHeight, 0));
      triangles.Add(new PolylineCurve(triPts));
    
      string levelLabel = (y / 1000.0 >= 0.0 ? "+" : "") + (y / 1000.0).ToString("0.000");
      Plane levelPlane = Plane.WorldXY;
      levelPlane.Origin = new Point3d(triStartX + triWidth + levelTextOffsetX, y + triHeight + levelTextOffsetY, 0);
      var levelTe = new TextEntity();
      levelTe.Plane = levelPlane;
      levelTe.PlainText = levelLabel;
      levelTe.TextHeight = levelTextH;
      levelTe.DimensionScale = 1.0;
      levelTe.Justification = TextJustification.MiddleCenter;
      levelTexts.Add(levelTe);
    
      if (i < floorCountSafe)
      {
        double yMid = y + floorHeightSafe * 0.5;
    
        Plane dimPlane = new Plane(new Point3d(dimX - textInset, yMid, 0), Vector3d.YAxis, Vector3d.XAxis);
        var dimTe = new TextEntity();
        dimTe.Plane = dimPlane;
        dimTe.PlainText = floorHeightSafe.ToString("0");
        dimTe.TextHeight = floorTextHSafe;
        dimTe.DimensionScale = 1.0;
        dimTe.Justification = TextJustification.MiddleCenter;
        floorTexts.Add(dimTe);
    
        Plane floorPlane = Plane.WorldXY;
        floorPlane.Origin = new Point3d(levelX + floorTextOffsetSafe, yMid, 0);
        var floorTe = new TextEntity();
        floorTe.Plane = floorPlane;
        floorTe.PlainText = (i + 1).ToString() + "F";
        floorTe.TextHeight = floorTextHSafe;
        floorTe.DimensionScale = 1.0;
        floorTe.Justification = TextJustification.MiddleCenter;
        floorTexts.Add(floorTe);
      }
    }
    
    Plane totalPlane = new Plane(new Point3d((dimX + levelX) * 0.5, totalHeight * 0.5, 0), Vector3d.YAxis, Vector3d.XAxis);
    var totalTe = new TextEntity();
    totalTe.Plane = totalPlane;
    totalTe.PlainText = totalHeight.ToString("0");
    totalTe.TextHeight = floorTextHSafe;
    totalTe.DimensionScale = 1.0;
    totalTe.Justification = TextJustification.MiddleCenter;
    floorTexts.Add(totalTe);
    
    report.Add("floors=" + floorCountSafe);
    report.Add("floorHeight=" + floorHeightSafe.ToString("0.###"));
    report.Add("totalHeight=" + totalHeight.ToString("0.###"));
    report.Add("dimX=" + dimX.ToString("0.###"));
    report.Add("levelX=" + levelX.ToString("0.###"));
    report.Add("axisClearGap=" + axisClearGap.ToString("0.###"));
    report.Add("dimLineStartX=" + dimLineStartX.ToString("0.###"));
    report.Add("levelTextOffsetX=" + levelTextOffsetX.ToString("0.###"));
    
    b = redLines;
    c = greenLines;
    d = triangles;
    e = levelTexts;
    f = floorTexts;
    g = report;
}
}
# ---------- end tianzheng_elevation_annotation ----------
