# Grasshopper definition RHINO PLP.gh (Grasshopper 1.0.8)
# plug-ins: TbGh21

# ----
# 调整图层打印线性
button = Button()
model_layer = ModelLayer(<model layer referenced from the Rhino model>)
model_layer_2 = ModelLayer(Layer=model_layer)  # -> Layer, Name, Hidden, Locked, DisplayColour, Material, Linetype
c_script = CSharpScript(layerInput=model_layer_2.Name, printWidth=Slider(150, range=0..1000), apply=button)  # -> out, a; inputs printWidth: Double, apply: Boolean
# ---------- c_script: C# ----------
#region Usings
using System;
using System.Collections;
using System.Collections.Generic;
using System.Drawing;
using System.Reflection;

using Rhino;
using Rhino.DocObjects;
using Rhino.Geometry;

using Grasshopper;
using Grasshopper.Kernel;
using Grasshopper.Kernel.Data;
using Grasshopper.Kernel.Types;
#endregion

public class Script_Instance : GH_ScriptInstance
{
  private void RunScript(
		object layerInput,
		double printWidth,
		bool apply,
		ref object a)
  {
    if (!apply)
    {
      a = "Press the button to update.";
      return;
    }

    if (RhinoDocument == null)
    {
      a = "RhinoDocument is null.";
      return;
    }

    Layer sourceLayer = ResolveLayer(layerInput);
    if (sourceLayer == null)
    {
      a = "Layer not found.";
      return;
    }

    if (printWidth < 0.0)
    {
      a = "Print width must be >= 0. Use 0 for hairline/default behavior.";
      return;
    }

    var layerCopy = new Layer();
    layerCopy.CopyAttributesFrom(sourceLayer);

    layerCopy.PlotWeight = printWidth;

    bool ok = RhinoDocument.Layers.Modify(layerCopy, sourceLayer.Id, true);
    RhinoDocument.Views.Redraw();

    a = ok
      ? string.Format("Updated print width: {0} -> {1}", sourceLayer.FullPath, printWidth)
      : "Update failed.";
  }

  private Layer ResolveLayer(object input)
  {
    object obj = Unwrap(input);

    if (obj is Layer l)
      return l;

    string name = obj as string;
    if (string.IsNullOrWhiteSpace(name))
      return null;

    int idx = RhinoDocument.Layers.FindByFullPath(name, -1);
    if (idx >= 0)
      return RhinoDocument.Layers[idx];

    for (int i = 0; i < RhinoDocument.Layers.Count; i++)
    {
      var lyr = RhinoDocument.Layers[i];
      if (lyr != null && !lyr.IsDeleted && string.Equals(lyr.Name, name, StringComparison.OrdinalIgnoreCase))
        return lyr;
    }

    return null;
  }

  private object Unwrap(object input)
  {
    object current = input;
    for (int i = 0; i < 3 && current != null; i++)
    {
      var prop = current.GetType().GetProperty("Value", BindingFlags.Instance | BindingFlags.Public);
      if (prop == null) break;

      var next = prop.GetValue(current, null);
      if (next == null || ReferenceEquals(next, current)) break;

      current = next;
    }
    return current;
  }
}
# ---------- end c_script ----------

# ----
# 调整图层hatch
button_2 = Button()
model_layer_3 = ModelLayer(<model layer referenced from the Rhino model>)
hatchpattern = HatchPattern("剖面线3")
model_layer_4 = ModelLayer(Layer=model_layer_3)  # -> Layer, Name, Hidden, Locked, DisplayColour, Material, Linetype
c_script_2 = CSharpScript(hatchPatternInput=hatchpattern, layerInput=model_layer_4.Name, apply=button_2)  # -> out, a; inputs apply: Boolean
# ---------- c_script_2: C# ----------
#region Usings
using System;
using System.Collections;
using System.Collections.Generic;
using System.Drawing;
using System.Reflection;

using Rhino;
using Rhino.DocObjects;
using Rhino.Geometry;

using Grasshopper;
using Grasshopper.Kernel;
using Grasshopper.Kernel.Data;
using Grasshopper.Kernel.Types;
#endregion

public class Script_Instance : GH_ScriptInstance
{
  private void RunScript(
		object hatchPatternInput,
		object layerInput,
		bool apply,
		ref object a)
  {
    if (!apply)
    {
      a = "Press the button to update.";
      return;
    }

    if (RhinoDocument == null)
    {
      a = "RhinoDocument is null.";
      return;
    }

    int hatchIndex = ResolveHatchPatternIndex(hatchPatternInput);
    if (hatchIndex < 0)
    {
      a = "Hatch pattern not found.";
      return;
    }

    Layer sourceLayer = ResolveLayer(layerInput);
    if (sourceLayer == null)
    {
      a = "Layer not found.";
      return;
    }

    var layerCopy = new Layer();
    layerCopy.CopyAttributesFrom(sourceLayer);

    var style = sourceLayer.GetCustomSectionStyle();
    if (style == null)
      style = new SectionStyle();
    else
      style.EnsurePrivateCopy();

    style.HatchIndex = hatchIndex;
    layerCopy.SetCustomSectionStyle(style);

    bool ok = RhinoDocument.Layers.Modify(layerCopy, sourceLayer.Id, true);
    RhinoDocument.Views.Redraw();

    a = ok ? "Updated layer hatch pattern." : "Update failed.";
  }

  private Layer ResolveLayer(object input)
  {
    object obj = Unwrap(input);

    if (obj is Layer l)
      return l;

    string name = obj as string;
    if (string.IsNullOrWhiteSpace(name))
      return null;

    int idx = RhinoDocument.Layers.FindByFullPath(name, -1);
    if (idx >= 0)
      return RhinoDocument.Layers[idx];

    for (int i = 0; i < RhinoDocument.Layers.Count; i++)
    {
      var lyr = RhinoDocument.Layers[i];
      if (lyr != null && !lyr.IsDeleted && string.Equals(lyr.Name, name, StringComparison.OrdinalIgnoreCase))
        return lyr;
    }

    return null;
  }

  private int ResolveHatchPatternIndex(object input)
  {
    object obj = Unwrap(input);

    if (obj is HatchPattern hp)
      return hp.Index;

    string name = obj as string;
    if (string.IsNullOrWhiteSpace(name))
      return -1;

    foreach (var p in RhinoDocument.HatchPatterns)
    {
      if (p == null || p.IsDeleted)
        continue;

      if (string.Equals(p.Name, name.Trim(), StringComparison.OrdinalIgnoreCase))
        return p.Index;
    }

    return -1;
  }

  private object Unwrap(object input)
  {
    object current = input;
    for (int i = 0; i < 3 && current != null; i++)
    {
      var prop = current.GetType().GetProperty("Value", BindingFlags.Instance | BindingFlags.Public);
      if (prop == null) break;

      var next = prop.GetValue(current, null);
      if (next == null || ReferenceEquals(next, current)) break;

      current = next;
    }
    return current;
  }
}
# ---------- end c_script_2 ----------

# ----
# 创建剖面
number_slider = Slider(150, range=0..1000)
c_script_3 = CSharpScript(run=Button(), curveWidth=number_slider)  # -> out, a; inputs allWidth: Double, curveWidth: Double
# ---------- c_script_3: C# ----------
#region Usings
using System;
using System.Collections;
using System.Collections.Generic;
using System.Drawing;

using Rhino;
using Rhino.DocObjects;
using Rhino.Geometry;
using Rhino.Input;
using Rhino.Input.Custom;

using Grasshopper;
using Grasshopper.Kernel;
using Grasshopper.Kernel.Data;
using Grasshopper.Kernel.Types;
#endregion

public class Script_Instance : GH_ScriptInstance
{
  private void RunScript(
		object run,
		double allWidth,
		double curveWidth,
		ref object a)
  {
    bool doRun = ToBool(run, false);
    if (!doRun)
    {
      a = "Idle. run 接 Button。allWidth 和 curveWidth 单位为 mm。";
      return;
    }

    RhinoDoc doc = RhinoDocument ?? RhinoDoc.ActiveDoc;
    if (doc == null)
    {
      a = "找不到 Rhino 文档。";
      return;
    }

    double allWidthMm = Math.Max(0.0, allWidth);
    double curveWidthMm = Math.Max(0.0, curveWidth);

    List<Guid> objectIdsBefore = GetExistingObjectIds(doc);

    List<Guid> clippingPlaneIds = PickClippingPlanes(doc);
    if (clippingPlaneIds.Count == 0)
    {
      a = "没有选择 ClippingPlane，已取消生成。";
      return;
    }

    doc.Objects.UnselectAll();

    int selected = SelectObjectsById(doc, clippingPlaneIds);
    if (selected == 0)
    {
      a = "没有成功选中 ClippingPlane。";
      return;
    }

    string command =
      "_ClippingDrawings " +
      "_Angle=0 " +
      "_PrintWidth=_ByLayer " +
      "_DisplayColor=_ByInputObject " +
      "_ShowHatch=_Yes " +
      "_ShowSolid=_Yes " +
      "_AddBackground=_Yes " +
      "_Projection=_Parallel " +
      "_AddHidden=_No " +
      "_AddSilhouette=_Yes " +
      "_ShowLabel=_Yes " +
      "_LabelStyle=_Dot " +
      "_ApplyToAll=_No " +
      "_Pause " +
      "_Enter";

    bool result = RhinoApp.RunScript(command, true);

    doc.Objects.UnselectAll();
    doc.Views.Redraw();

    List<Guid> newObjectIds = GetNewObjectIds(doc, objectIdsBefore);

    int foundAll;
    int changedAllLayers;
    int foundCurve;
    int changedCurveLayers;
    int resetObjectsToByLayer;
    int hiddenSolidLayers;

    ApplyLayerPlotWeightsToNewDrawing(
      doc,
      newObjectIds,
      allWidthMm,
      curveWidthMm,
      out foundAll,
      out changedAllLayers,
      out foundCurve,
      out changedCurveLayers,
      out resetObjectsToByLayer,
      out hiddenSolidLayers
    );

    doc.Views.Redraw();

    a =
      (result ? "完成。已创建 ClippingDrawing。\n" : "ClippingDrawings 命令没有成功完成，请查看 Rhino 命令行历史。\n") +
      "本次新对象数：" + newObjectIds.Count + "\n" +
      "普通图层目标：" + allWidthMm.ToString("0.###") + " mm\n" +
      "Curve 图层目标：" + curveWidthMm.ToString("0.###") + " mm\n" +
      "普通图层：找到 " + foundAll + "，修改 " + changedAllLayers + "\n" +
      "Curve 图层：找到 " + foundCurve + "，修改 " + changedCurveLayers + "\n" +
      "对象打印线宽设为 ByLayer 数：" + resetObjectsToByLayer + "\n" +
      "隐藏 Solid 图层数：" + hiddenSolidLayers;
  }

  private static void ApplyLayerPlotWeightsToNewDrawing(
    RhinoDoc doc,
    List<Guid> newObjectIds,
    double allWidthMm,
    double curveWidthMm,
    out int foundAll,
    out int changedAllLayers,
    out int foundCurve,
    out int changedCurveLayers,
    out int resetObjectsToByLayer,
    out int hiddenSolidLayers)
  {
    foundAll = 0;
    changedAllLayers = 0;
    foundCurve = 0;
    changedCurveLayers = 0;
    resetObjectsToByLayer = 0;
    hiddenSolidLayers = 0;

    List<int> touchedLayerIndexes = new List<int>();
    List<int> hiddenSolidLayerIndexes = new List<int>();

    foreach (Guid objectId in newObjectIds)
    {
      RhinoObject obj = doc.Objects.FindId(objectId);
      if (obj == null)
        continue;

      Layer layer = doc.Layers[obj.Attributes.LayerIndex];
      bool isCurveLayer = IsCurveLayer(layer);
      bool isSolidLayer = IsSolidLayer(layer);
      double targetWidth = isCurveLayer ? curveWidthMm : allWidthMm;

      if (!touchedLayerIndexes.Contains(obj.Attributes.LayerIndex))
      {
        touchedLayerIndexes.Add(obj.Attributes.LayerIndex);

        if (isCurveLayer)
          foundCurve++;
        else
          foundAll++;

        Layer layerCopy = new Layer();
        layerCopy.CopyAttributesFrom(layer);
        layerCopy.PlotWeight = targetWidth;

        bool layerOk = doc.Layers.Modify(layerCopy, layer.Id, true);
        if (layerOk)
        {
          if (isCurveLayer)
            changedCurveLayers++;
          else
            changedAllLayers++;
        }
      }

      if (isSolidLayer && !hiddenSolidLayerIndexes.Contains(obj.Attributes.LayerIndex))
      {
        hiddenSolidLayerIndexes.Add(obj.Attributes.LayerIndex);

        Layer hideLayerCopy = new Layer();
        hideLayerCopy.CopyAttributesFrom(layer);
        hideLayerCopy.IsVisible = false;

        bool hideOk = doc.Layers.Modify(hideLayerCopy, layer.Id, true);
        if (hideOk)
          hiddenSolidLayers++;
      }

      ObjectAttributes attr = obj.Attributes.Duplicate();
      attr.PlotWeightSource = ObjectPlotWeightSource.PlotWeightFromLayer;

      bool objOk = doc.Objects.ModifyAttributes(obj, attr, true);
      if (objOk)
        resetObjectsToByLayer++;
    }
  }

  private static bool IsCurveLayer(Layer layer)
  {
    if (layer == null)
      return false;

    string name = layer.Name ?? "";
    string fullPath = layer.FullPath ?? name;

    return name.IndexOf("Curve", StringComparison.OrdinalIgnoreCase) >= 0
      || fullPath.IndexOf("Curve", StringComparison.OrdinalIgnoreCase) >= 0
      || name.IndexOf("曲线", StringComparison.OrdinalIgnoreCase) >= 0
      || fullPath.IndexOf("曲线", StringComparison.OrdinalIgnoreCase) >= 0;
  }

  private static bool IsSolidLayer(Layer layer)
  {
    if (layer == null)
      return false;

    string name = layer.Name ?? "";
    string fullPath = layer.FullPath ?? name;

    return name.IndexOf("Solid", StringComparison.OrdinalIgnoreCase) >= 0
      || fullPath.IndexOf("Solid", StringComparison.OrdinalIgnoreCase) >= 0
      || name.IndexOf("实体", StringComparison.OrdinalIgnoreCase) >= 0
      || fullPath.IndexOf("实体", StringComparison.OrdinalIgnoreCase) >= 0;
  }

  private static List<Guid> GetExistingObjectIds(RhinoDoc doc)
  {
    List<Guid> ids = new List<Guid>();

    ObjectEnumeratorSettings settings = new ObjectEnumeratorSettings();
    settings.HiddenObjects = true;
    settings.LockedObjects = true;
    settings.NormalObjects = true;
    settings.IncludeGrips = false;
    settings.IncludeLights = false;

    foreach (RhinoObject obj in doc.Objects.GetObjectList(settings))
    {
      if (obj != null && !ids.Contains(obj.Id))
        ids.Add(obj.Id);
    }

    return ids;
  }

  private static List<Guid> GetNewObjectIds(RhinoDoc doc, List<Guid> beforeIds)
  {
    List<Guid> ids = new List<Guid>();

    ObjectEnumeratorSettings settings = new ObjectEnumeratorSettings();
    settings.HiddenObjects = true;
    settings.LockedObjects = true;
    settings.NormalObjects = true;
    settings.IncludeGrips = false;
    settings.IncludeLights = false;

    foreach (RhinoObject obj in doc.Objects.GetObjectList(settings))
    {
      if (obj == null)
        continue;

      if (beforeIds.Contains(obj.Id))
        continue;

      if (!ids.Contains(obj.Id))
        ids.Add(obj.Id);
    }

    return ids;
  }

  private static List<Guid> PickClippingPlanes(RhinoDoc doc)
  {
    List<Guid> ids = new List<Guid>();

    GetObject go = new GetObject();
    go.SetCommandPrompt("选择要生成 ClippingDrawing 的 ClippingPlane，回车结束");
    go.GeometryFilter = ObjectType.ClipPlane;
    go.EnablePreSelect(true, true);
    go.EnablePostSelect(true);
    go.GetMultiple(1, 0);

    if (go.CommandResult() != Rhino.Commands.Result.Success)
      return ids;

    for (int i = 0; i < go.ObjectCount; i++)
    {
      RhinoObject obj = go.Object(i).Object();
      if (IsClippingPlane(obj) && !ids.Contains(obj.Id))
        ids.Add(obj.Id);
    }

    return ids;
  }

  private static bool IsClippingPlane(RhinoObject obj)
  {
    return obj != null && obj.Geometry is ClippingPlaneSurface;
  }

  private static int SelectObjectsById(RhinoDoc doc, IEnumerable<Guid> ids)
  {
    int count = 0;

    foreach (Guid id in ids)
    {
      RhinoObject obj = doc.Objects.FindId(id);
      if (obj == null)
        continue;

      obj.Select(true);
      count++;
    }

    doc.Views.Redraw();
    return count;
  }

  private static bool ToBool(object value, bool fallback)
  {
    if (value == null)
      return fallback;

    if (value is bool)
      return (bool)value;

    bool parsed;
    if (bool.TryParse(value.ToString(), out parsed))
      return parsed;

    return fallback;
  }
}
# ---------- end c_script_3 ----------

# ----
# 创建剖面
number_slider_2 = Slider(150, range=0..1000)
c_script_4 = CSharpScript(run=Button(), curveWidth=number_slider_2)  # -> out, a; inputs allWidth: Double, curveWidth: Double
# ---------- c_script_4: C# ----------
#region Usings
using System;
using System.Collections;
using System.Collections.Generic;
using System.Drawing;

using Rhino;
using Rhino.DocObjects;
using Rhino.Geometry;
using Rhino.Input;
using Rhino.Input.Custom;

using Grasshopper;
using Grasshopper.Kernel;
using Grasshopper.Kernel.Data;
using Grasshopper.Kernel.Types;
#endregion

public class Script_Instance : GH_ScriptInstance
{
  private void RunScript(
		object run,
		double allWidth,
		double curveWidth,
		ref object a)
  {
    bool doRun = ToBool(run, false);
    if (!doRun)
    {
      a = "Idle. run 接 Button。allWidth 和 curveWidth 单位为 mm。";
      return;
    }

    RhinoDoc doc = RhinoDocument ?? RhinoDoc.ActiveDoc;
    if (doc == null)
    {
      a = "找不到 Rhino 文档。";
      return;
    }

    double allWidthMm = Math.Max(0.0, allWidth);
    double curveWidthMm = Math.Max(0.0, curveWidth);

    List<Guid> objectIdsBefore = GetExistingObjectIds(doc);

    List<Guid> clippingPlaneIds = PickClippingPlanes(doc);
    if (clippingPlaneIds.Count == 0)
    {
      a = "没有选择 ClippingPlane，已取消生成。";
      return;
    }

    doc.Objects.UnselectAll();

    int selected = SelectObjectsById(doc, clippingPlaneIds);
    if (selected == 0)
    {
      a = "没有成功选中 ClippingPlane。";
      return;
    }

    string command =
      "_ClippingDrawings " +
      "_Angle=0 " +
      "_PrintWidth=_ByLayer " +
      "_DisplayColor=_ByInputObject " +
      "_ShowHatch=_Yes " +
      "_ShowSolid=_Yes " +
      "_AddBackground=_Yes " +
      "_Projection=_Parallel " +
      "_AddHidden=_No " +
      "_AddSilhouette=_Yes " +
      "_ShowLabel=_Yes " +
      "_LabelStyle=_Dot " +
      "_ApplyToAll=_No " +
      "_Pause " +
      "_Enter";

    bool result = RhinoApp.RunScript(command, true);

    doc.Objects.UnselectAll();
    doc.Views.Redraw();

    List<Guid> newObjectIds = GetNewObjectIds(doc, objectIdsBefore);

    int foundAll;
    int changedAllLayers;
    int changedAllObjects;
    int foundCurve;
    int changedCurveLayers;
    int changedCurveObjects;
    int hiddenSolidLayers;

    ApplyPlotWeightsToNewDrawing(
      doc,
      newObjectIds,
      allWidthMm,
      curveWidthMm,
      out foundAll,
      out changedAllLayers,
      out changedAllObjects,
      out foundCurve,
      out changedCurveLayers,
      out changedCurveObjects,
      out hiddenSolidLayers
    );

    doc.Views.Redraw();

    a =
      (result ? "完成。已创建 ClippingDrawing。\n" : "ClippingDrawings 命令没有成功完成，请查看 Rhino 命令行历史。\n") +
      "本次新对象数：" + newObjectIds.Count + "\n" +
      "普通线目标：" + allWidthMm.ToString("0.###") + " mm\n" +
      "Curve 目标：" + curveWidthMm.ToString("0.###") + " mm\n" +
      "普通对象：找到 " + foundAll + "，图层修改 " + changedAllLayers + "，对象兜底修改 " + changedAllObjects + "\n" +
      "Curve 对象：找到 " + foundCurve + "，图层修改 " + changedCurveLayers + "，对象兜底修改 " + changedCurveObjects + "\n" +
      "隐藏 Solid 图层数：" + hiddenSolidLayers;
  }

  private static void ApplyPlotWeightsToNewDrawing(
    RhinoDoc doc,
    List<Guid> newObjectIds,
    double allWidthMm,
    double curveWidthMm,
    out int foundAll,
    out int changedAllLayers,
    out int changedAllObjects,
    out int foundCurve,
    out int changedCurveLayers,
    out int changedCurveObjects,
    out int hiddenSolidLayers)
  {
    foundAll = 0;
    changedAllLayers = 0;
    changedAllObjects = 0;
    foundCurve = 0;
    changedCurveLayers = 0;
    changedCurveObjects = 0;
    hiddenSolidLayers = 0;

    List<int> touchedLayerIndexes = new List<int>();
    List<int> hiddenSolidLayerIndexes = new List<int>();

    foreach (Guid objectId in newObjectIds)
    {
      RhinoObject obj = doc.Objects.FindId(objectId);
      if (obj == null)
        continue;

      Layer layer = doc.Layers[obj.Attributes.LayerIndex];
      bool isCurveLayer = IsCurveLayer(layer);
      bool isSolidLayer = IsSolidLayer(layer);
      double targetWidth = isCurveLayer ? curveWidthMm : allWidthMm;

      if (isCurveLayer)
        foundCurve++;
      else
        foundAll++;

      if (!touchedLayerIndexes.Contains(obj.Attributes.LayerIndex))
      {
        touchedLayerIndexes.Add(obj.Attributes.LayerIndex);

        Layer layerCopy = new Layer();
        layerCopy.CopyAttributesFrom(layer);
        layerCopy.PlotWeight = targetWidth;

        bool layerOk = doc.Layers.Modify(layerCopy, layer.Id, true);
        if (layerOk)
        {
          if (isCurveLayer)
            changedCurveLayers++;
          else
            changedAllLayers++;
        }
      }

      if (isSolidLayer && !hiddenSolidLayerIndexes.Contains(obj.Attributes.LayerIndex))
      {
        hiddenSolidLayerIndexes.Add(obj.Attributes.LayerIndex);

        Layer hideLayerCopy = new Layer();
        hideLayerCopy.CopyAttributesFrom(layer);
        hideLayerCopy.IsVisible = false;

        bool hideOk = doc.Layers.Modify(hideLayerCopy, layer.Id, true);
        if (hideOk)
          hiddenSolidLayers++;
      }

      ObjectAttributes attr = obj.Attributes.Duplicate();
      attr.PlotWeightSource = ObjectPlotWeightSource.PlotWeightFromObject;
      attr.PlotWeight = targetWidth;

      bool objOk = doc.Objects.ModifyAttributes(obj, attr, true);
      if (objOk)
      {
        if (isCurveLayer)
          changedCurveObjects++;
        else
          changedAllObjects++;
      }
    }
  }

  private static bool IsCurveLayer(Layer layer)
  {
    if (layer == null)
      return false;

    string name = layer.Name ?? "";
    string fullPath = layer.FullPath ?? name;

    return name.IndexOf("Curve", StringComparison.OrdinalIgnoreCase) >= 0
      || fullPath.IndexOf("Curve", StringComparison.OrdinalIgnoreCase) >= 0
      || name.IndexOf("曲线", StringComparison.OrdinalIgnoreCase) >= 0
      || fullPath.IndexOf("曲线", StringComparison.OrdinalIgnoreCase) >= 0;
  }

  private static bool IsSolidLayer(Layer layer)
  {
    if (layer == null)
      return false;

    string name = layer.Name ?? "";
    string fullPath = layer.FullPath ?? name;

    return name.IndexOf("Solid", StringComparison.OrdinalIgnoreCase) >= 0
      || fullPath.IndexOf("Solid", StringComparison.OrdinalIgnoreCase) >= 0
      || name.IndexOf("实体", StringComparison.OrdinalIgnoreCase) >= 0
      || fullPath.IndexOf("实体", StringComparison.OrdinalIgnoreCase) >= 0;
  }

  private static List<Guid> GetExistingObjectIds(RhinoDoc doc)
  {
    List<Guid> ids = new List<Guid>();

    ObjectEnumeratorSettings settings = new ObjectEnumeratorSettings();
    settings.HiddenObjects = true;
    settings.LockedObjects = true;
    settings.NormalObjects = true;
    settings.IncludeGrips = false;
    settings.IncludeLights = false;

    foreach (RhinoObject obj in doc.Objects.GetObjectList(settings))
    {
      if (obj != null && !ids.Contains(obj.Id))
        ids.Add(obj.Id);
    }

    return ids;
  }

  private static List<Guid> GetNewObjectIds(RhinoDoc doc, List<Guid> beforeIds)
  {
    List<Guid> ids = new List<Guid>();

    ObjectEnumeratorSettings settings = new ObjectEnumeratorSettings();
    settings.HiddenObjects = true;
    settings.LockedObjects = true;
    settings.NormalObjects = true;
    settings.IncludeGrips = false;
    settings.IncludeLights = false;

    foreach (RhinoObject obj in doc.Objects.GetObjectList(settings))
    {
      if (obj == null)
        continue;

      if (beforeIds.Contains(obj.Id))
        continue;

      if (!ids.Contains(obj.Id))
        ids.Add(obj.Id);
    }

    return ids;
  }

  private static List<Guid> PickClippingPlanes(RhinoDoc doc)
  {
    List<Guid> ids = new List<Guid>();

    GetObject go = new GetObject();
    go.SetCommandPrompt("选择要生成 ClippingDrawing 的 ClippingPlane，回车结束");
    go.GeometryFilter = ObjectType.ClipPlane;
    go.EnablePreSelect(true, true);
    go.EnablePostSelect(true);
    go.GetMultiple(1, 0);

    if (go.CommandResult() != Rhino.Commands.Result.Success)
      return ids;

    for (int i = 0; i < go.ObjectCount; i++)
    {
      RhinoObject obj = go.Object(i).Object();
      if (IsClippingPlane(obj) && !ids.Contains(obj.Id))
        ids.Add(obj.Id);
    }

    return ids;
  }

  private static bool IsClippingPlane(RhinoObject obj)
  {
    return obj != null && obj.Geometry is ClippingPlaneSurface;
  }

  private static int SelectObjectsById(RhinoDoc doc, IEnumerable<Guid> ids)
  {
    int count = 0;

    foreach (Guid id in ids)
    {
      RhinoObject obj = doc.Objects.FindId(id);
      if (obj == null)
        continue;

      obj.Select(true);
      count++;
    }

    doc.Views.Redraw();
    return count;
  }

  private static bool ToBool(object value, bool fallback)
  {
    if (value == null)
      return fallback;

    if (value is bool)
      return (bool)value;

    bool parsed;
    if (bool.TryParse(value.ToString(), out parsed))
      return parsed;

    return fallback;
  }
}
# ---------- end c_script_4 ----------

# ----
# 平面（剖面线加粗
# 平面（替换门？
button_3 = Button()

# ----
# 立面（外轮廓ture并加粗）
boolean_toggle = BooleanToggle(True)
button_4 = Button()
c_script_5 = CSharpScript(run=boolean_toggle, curveWidth=Slider(150, range=0..1000))  # -> out, a; inputs allWidth: Double, curveWidth: Double
# ---------- c_script_5: C# ----------
#region Usings
using System;
using System.Collections;
using System.Collections.Generic;
using System.Drawing;

using Rhino;
using Rhino.DocObjects;
using Rhino.Geometry;
using Rhino.Input;
using Rhino.Input.Custom;

using Grasshopper;
using Grasshopper.Kernel;
using Grasshopper.Kernel.Data;
using Grasshopper.Kernel.Types;
#endregion

public class Script_Instance : GH_ScriptInstance
{
  private void RunScript(
		object run,
		double allWidth,
		double curveWidth,
		ref object a)
  {
    bool doRun = ToBool(run, false);
    if (!doRun)
    {
      a = "Idle. run 接 Button。allWidth 和 outlineWidth 单位为 mm。";
      return;
    }

    RhinoDoc doc = RhinoDocument ?? RhinoDoc.ActiveDoc;
    if (doc == null)
    {
      a = "找不到 Rhino 文档。";
      return;
    }

    double allWidthMm = Math.Max(0.0, allWidth);
    double outlineWidthMm = Math.Max(0.0, curveWidth);

    List<Guid> objectIdsBefore = GetExistingObjectIds(doc);

    List<Guid> clippingPlaneIds = PickClippingPlanes(doc);
    if (clippingPlaneIds.Count == 0)
    {
      a = "没有选择 ClippingPlane，已取消生成。";
      return;
    }

    doc.Objects.UnselectAll();

    int selected = SelectObjectsById(doc, clippingPlaneIds);
    if (selected == 0)
    {
      a = "没有成功选中 ClippingPlane。";
      return;
    }

    string command =
      "_ClippingDrawings " +
      "_Angle=0 " +
      "_PrintWidth=_ByLayer " +
      "_DisplayColor=_ByInputObject " +
      "_ShowHatch=_Yes " +
      "_ShowSolid=_Yes " +
      "_AddBackground=_Yes " +
      "_Projection=_Parallel " +
      "_AddHidden=_No " +
      "_AddSilhouette=_Yes " +
      "_ShowLabel=_Yes " +
      "_LabelStyle=_Dot " +
      "_ApplyToAll=_No " +
      "_Pause " +
      "_Enter";

    bool result = RhinoApp.RunScript(command, true);

    doc.Objects.UnselectAll();
    doc.Views.Redraw();

    List<Guid> newObjectIds = GetNewObjectIds(doc, objectIdsBefore);

    int foundAll;
    int changedAllLayers;
    int foundOutline;
    int changedOutlineLayers;
    int resetObjectsToByLayer;
    int hiddenSolidLayers;

    ApplyLayerPlotWeightsToNewDrawing(
      doc,
      newObjectIds,
      allWidthMm,
      outlineWidthMm,
      out foundAll,
      out changedAllLayers,
      out foundOutline,
      out changedOutlineLayers,
      out resetObjectsToByLayer,
      out hiddenSolidLayers
    );

    doc.Views.Redraw();

    a =
      (result ? "完成。已创建立面 ClippingDrawing。\n" : "ClippingDrawings 命令没有成功完成，请查看 Rhino 命令行历史。\n") +
      "本次新对象数：" + newObjectIds.Count + "\n" +
      "普通图层目标：" + allWidthMm.ToString("0.###") + " mm\n" +
      "外轮廓图层目标：" + outlineWidthMm.ToString("0.###") + " mm\n" +
      "普通图层：找到 " + foundAll + "，修改 " + changedAllLayers + "\n" +
      "外轮廓图层：找到 " + foundOutline + "，修改 " + changedOutlineLayers + "\n" +
      "对象打印线宽设为 ByLayer 数：" + resetObjectsToByLayer + "\n" +
      "隐藏 Solid 图层数：" + hiddenSolidLayers;
  }

  private static void ApplyLayerPlotWeightsToNewDrawing(
    RhinoDoc doc,
    List<Guid> newObjectIds,
    double allWidthMm,
    double outlineWidthMm,
    out int foundAll,
    out int changedAllLayers,
    out int foundOutline,
    out int changedOutlineLayers,
    out int resetObjectsToByLayer,
    out int hiddenSolidLayers)
  {
    foundAll = 0;
    changedAllLayers = 0;
    foundOutline = 0;
    changedOutlineLayers = 0;
    resetObjectsToByLayer = 0;
    hiddenSolidLayers = 0;

    List<int> touchedLayerIndexes = new List<int>();
    List<int> hiddenSolidLayerIndexes = new List<int>();

    foreach (Guid objectId in newObjectIds)
    {
      RhinoObject obj = doc.Objects.FindId(objectId);
      if (obj == null)
        continue;

      Layer layer = doc.Layers[obj.Attributes.LayerIndex];
      bool isOutlineLayer = IsOutlineLayer(layer);
      bool isSolidLayer = IsSolidLayer(layer);
      double targetWidth = isOutlineLayer ? outlineWidthMm : allWidthMm;

      if (!touchedLayerIndexes.Contains(obj.Attributes.LayerIndex))
      {
        touchedLayerIndexes.Add(obj.Attributes.LayerIndex);

        if (isOutlineLayer)
          foundOutline++;
        else
          foundAll++;

        Layer layerCopy = new Layer();
        layerCopy.CopyAttributesFrom(layer);
        layerCopy.PlotWeight = targetWidth;

        bool layerOk = doc.Layers.Modify(layerCopy, layer.Id, true);
        if (layerOk)
        {
          if (isOutlineLayer)
            changedOutlineLayers++;
          else
            changedAllLayers++;
        }
      }

      if (isSolidLayer && !hiddenSolidLayerIndexes.Contains(obj.Attributes.LayerIndex))
      {
        hiddenSolidLayerIndexes.Add(obj.Attributes.LayerIndex);

        Layer hideLayerCopy = new Layer();
        hideLayerCopy.CopyAttributesFrom(layer);
        hideLayerCopy.IsVisible = false;

        bool hideOk = doc.Layers.Modify(hideLayerCopy, layer.Id, true);
        if (hideOk)
          hiddenSolidLayers++;
      }

      ObjectAttributes attr = obj.Attributes.Duplicate();
      attr.PlotWeightSource = ObjectPlotWeightSource.PlotWeightFromLayer;

      bool objOk = doc.Objects.ModifyAttributes(obj, attr, true);
      if (objOk)
        resetObjectsToByLayer++;
    }
  }

  private static bool IsOutlineLayer(Layer layer)
  {
    if (layer == null)
      return false;

    string name = layer.Name ?? "";
    string fullPath = layer.FullPath ?? name;

    return name.IndexOf("Silhouette", StringComparison.OrdinalIgnoreCase) >= 0
      || fullPath.IndexOf("Silhouette", StringComparison.OrdinalIgnoreCase) >= 0
      || name.IndexOf("Outline", StringComparison.OrdinalIgnoreCase) >= 0
      || fullPath.IndexOf("Outline", StringComparison.OrdinalIgnoreCase) >= 0
      || name.IndexOf("轮廓", StringComparison.OrdinalIgnoreCase) >= 0
      || fullPath.IndexOf("轮廓", StringComparison.OrdinalIgnoreCase) >= 0
      || name.IndexOf("外轮廓", StringComparison.OrdinalIgnoreCase) >= 0
      || fullPath.IndexOf("外轮廓", StringComparison.OrdinalIgnoreCase) >= 0;
  }

  private static bool IsSolidLayer(Layer layer)
  {
    if (layer == null)
      return false;

    string name = layer.Name ?? "";
    string fullPath = layer.FullPath ?? name;

    return name.IndexOf("Solid", StringComparison.OrdinalIgnoreCase) >= 0
      || fullPath.IndexOf("Solid", StringComparison.OrdinalIgnoreCase) >= 0
      || name.IndexOf("实体", StringComparison.OrdinalIgnoreCase) >= 0
      || fullPath.IndexOf("实体", StringComparison.OrdinalIgnoreCase) >= 0;
  }

  private static List<Guid> GetExistingObjectIds(RhinoDoc doc)
  {
    List<Guid> ids = new List<Guid>();

    ObjectEnumeratorSettings settings = new ObjectEnumeratorSettings();
    settings.HiddenObjects = true;
    settings.LockedObjects = true;
    settings.NormalObjects = true;
    settings.IncludeGrips = false;
    settings.IncludeLights = false;

    foreach (RhinoObject obj in doc.Objects.GetObjectList(settings))
    {
      if (obj != null && !ids.Contains(obj.Id))
        ids.Add(obj.Id);
    }

    return ids;
  }

  private static List<Guid> GetNewObjectIds(RhinoDoc doc, List<Guid> beforeIds)
  {
    List<Guid> ids = new List<Guid>();

    ObjectEnumeratorSettings settings = new ObjectEnumeratorSettings();
    settings.HiddenObjects = true;
    settings.LockedObjects = true;
    settings.NormalObjects = true;
    settings.IncludeGrips = false;
    settings.IncludeLights = false;

    foreach (RhinoObject obj in doc.Objects.GetObjectList(settings))
    {
      if (obj == null)
        continue;

      if (beforeIds.Contains(obj.Id))
        continue;

      if (!ids.Contains(obj.Id))
        ids.Add(obj.Id);
    }

    return ids;
  }

  private static List<Guid> PickClippingPlanes(RhinoDoc doc)
  {
    List<Guid> ids = new List<Guid>();

    GetObject go = new GetObject();
    go.SetCommandPrompt("选择要生成 ClippingDrawing 的 ClippingPlane，回车结束");
    go.GeometryFilter = ObjectType.ClipPlane;
    go.EnablePreSelect(true, true);
    go.EnablePostSelect(true);
    go.GetMultiple(1, 0);

    if (go.CommandResult() != Rhino.Commands.Result.Success)
      return ids;

    for (int i = 0; i < go.ObjectCount; i++)
    {
      RhinoObject obj = go.Object(i).Object();
      if (IsClippingPlane(obj) && !ids.Contains(obj.Id))
        ids.Add(obj.Id);
    }

    return ids;
  }

  private static bool IsClippingPlane(RhinoObject obj)
  {
    return obj != null && obj.Geometry is ClippingPlaneSurface;
  }

  private static int SelectObjectsById(RhinoDoc doc, IEnumerable<Guid> ids)
  {
    int count = 0;

    foreach (Guid id in ids)
    {
      RhinoObject obj = doc.Objects.FindId(id);
      if (obj == null)
        continue;

      obj.Select(true);
      count++;
    }

    doc.Views.Redraw();
    return count;
  }

  private static bool ToBool(object value, bool fallback)
  {
    if (value == null)
      return fallback;

    if (value is bool)
      return (bool)value;

    bool parsed;
    if (bool.TryParse(value.ToString(), out parsed))
      return parsed;

    return fallback;
  }
}
# ---------- end c_script_5 ----------

c_script_6 = CSharpScript(x=button_3)  # -> out, a
# ---------- c_script_6: C# ----------
// Grasshopper Script Instance
#region Usings
using System;
using System.Linq;
using System.Collections;
using System.Collections.Generic;
using System.Drawing;

using Rhino;
using Rhino.Geometry;
using Rhino.DocObjects;
using Rhino.Input;
using Rhino.Input.Custom;

using Grasshopper;
using Grasshopper.Kernel;
using Grasshopper.Kernel.Data;
using Grasshopper.Kernel.Types;
#endregion

public class Script_Instance : GH_ScriptInstance
{
    #region Notes
    /* 
      Members:
        RhinoDoc RhinoDocument
        GH_Document GrasshopperDocument
        IGH_Component Component
        int Iteration

      Methods (Virtual & overridable):
        Print(string text)
        Print(string format, params object[] args)
        Reflect(object obj)
        Reflect(object obj, string method_name)
    */
    #endregion

    private void RunScript(object x, ref object a)
    {
        bool run = ToBool(x, false);
        if (!run)
        {
            a = "Idle. 把 x 接 Button，点击后运行。";
            return;
        }

        RhinoDoc doc = RhinoDocument ?? RhinoDoc.ActiveDoc;
        if (doc == null)
        {
            a = "找不到 Rhino 文档。";
            return;
        }

        List<Guid> clippingPlaneIds = PickClippingPlanes(doc);

        if (clippingPlaneIds.Count == 0)
        {
            a = "没有选择 ClippingPlane，已取消。";
            return;
        }

        doc.Objects.UnselectAll();

        int selected = SelectObjectsById(doc, clippingPlaneIds);
        if (selected == 0)
        {
            a = "没有成功选中 ClippingPlane。";
            return;
        }

        string command =
            "_ClippingDrawings " +
            "_Angle=0 " +
            "_PrintWidth=_ByLayer " +
            "_DisplayColor=_ByInputObject " +
            "_ShowHatch=_Yes " +
            "_ShowSolid=_Yes " +
            "_AddBackground=_Yes " +
            "_Projection=_Parallel " +
            "_AddHidden=_No " +
            "_AddSilhouette=_No " +
            "_ShowLabel=_Yes " +
            "_LabelStyle=_Dot " +
            "_ApplyToAll=_No " +
            "_Pause " +
            "_Enter";

        bool result = RhinoApp.RunScript(command, true);

        doc.Objects.UnselectAll();
        doc.Views.Redraw();

        if (result)
            a = "完成。已按指定参数在 Rhino 当前文件中创建 ClippingDrawing。";
        else
            a = "ClippingDrawings 命令没有成功完成，请查看 Rhino 命令行历史。";
    }

    private static List<Guid> PickClippingPlanes(RhinoDoc doc)
    {
        List<Guid> ids = new List<Guid>();

        GetObject go = new GetObject();
        go.SetCommandPrompt("选择要生成 ClippingDrawing 的 ClippingPlane，回车结束");
        go.GeometryFilter = ObjectType.ClipPlane;
        go.EnablePreSelect(true, true);
        go.EnablePostSelect(true);
        go.GetMultiple(1, 0);

        if (go.CommandResult() != Rhino.Commands.Result.Success)
            return ids;

        for (int i = 0; i < go.ObjectCount; i++)
        {
            RhinoObject obj = go.Object(i).Object();
            if (IsClippingPlane(obj) && !ids.Contains(obj.Id))
                ids.Add(obj.Id);
        }

        return ids;
    }

    private static bool IsClippingPlane(RhinoObject obj)
    {
        return obj != null && obj.Geometry is ClippingPlaneSurface;
    }

    private static int SelectObjectsById(RhinoDoc doc, IEnumerable<Guid> ids)
    {
        int count = 0;

        foreach (Guid id in ids)
        {
            RhinoObject obj = doc.Objects.FindId(id);
            if (obj == null)
                continue;

            obj.Select(true);
            count++;
        }

        doc.Views.Redraw();
        return count;
    }

    private static bool ToBool(object value, bool fallback)
    {
        if (value == null)
            return fallback;

        if (value is bool)
            return (bool)value;

        bool parsed;
        if (bool.TryParse(value.ToString(), out parsed))
            return parsed;

        return fallback;
    }
}
# ---------- end c_script_6 ----------

# ----
# 根据颜色筛选物件到图层
model_layer_5 = ModelLayer(<model layer referenced from the Rhino model>)
model_layer_6 = ModelLayer(<model layer referenced from the Rhino model>)
model_layer_7 = ModelLayer(Layer=model_layer_5)  # -> Layer, Name, Hidden, Locked, DisplayColour, Material, Linetype
model_layer_8 = ModelLayer(Layer=model_layer_6)  # -> Layer, Name, Hidden, Locked, DisplayColour, Material, Linetype
c_script_7 = CSharpScript(sourceLayerInput=model_layer_8.Name, glassLayerInput=model_layer_7.Name, apply=Button())  # -> out, a; inputs apply: Boolean
# ---------- c_script_7: C# ----------
#region Usings
using System;
using System.Collections;
using System.Collections.Generic;
using System.Drawing;
using System.Reflection;

using Rhino;
using Rhino.DocObjects;
using Rhino.Geometry;

using Grasshopper;
using Grasshopper.Kernel;
using Grasshopper.Kernel.Data;
using Grasshopper.Kernel.Types;
#endregion

public class Script_Instance : GH_ScriptInstance
{
  private void RunScript(
		object sourceLayerInput,
		object glassLayerInput,
		bool apply,
		ref object a)
  {
    if (!apply)
    {
      a = "Press the button to run.";
      return;
    }

    if (RhinoDocument == null)
    {
      a = "RhinoDocument is null.";
      return;
    }

    Layer sourceLayer = ResolveLayer(sourceLayerInput);
    if (sourceLayer == null)
    {
      a = "Source layer not found.";
      return;
    }

    Layer glassSourceLayer = ResolveLayer(glassLayerInput);
    if (glassSourceLayer == null)
    {
      a = "Glass color layer not found.";
      return;
    }

    Color glassColor = glassSourceLayer.Color;

    int targetLayerIndex = EnsureSiblingLayer(sourceLayer, "玻璃", glassColor);
    if (targetLayerIndex < 0)
    {
      a = "Failed to create or find target layer.";
      return;
    }

    int movedCount = 0;

    foreach (RhinoObject obj in RhinoDocument.Objects)
    {
      if (obj == null) continue;
      if (obj.IsDeleted) continue;

      if (obj.Attributes.LayerIndex != sourceLayer.Index)
        continue;

      Color objColor = obj.Attributes.DrawColor(RhinoDocument);
      if (objColor.ToArgb() != glassColor.ToArgb())
        continue;

      ObjectAttributes newAttr = obj.Attributes.Duplicate();
      newAttr.LayerIndex = targetLayerIndex;

      bool ok = RhinoDocument.Objects.ModifyAttributes(obj, newAttr, true);
      if (ok) movedCount++;
    }

    RhinoDocument.Views.Redraw();

    Layer targetLayer = RhinoDocument.Layers[targetLayerIndex];
    a = string.Format(
      "Moved {0} object(s) from \"{1}\" to \"{2}\" using color from layer \"{3}\".",
      movedCount,
      sourceLayer.FullPath,
      targetLayer.FullPath,
      glassSourceLayer.FullPath
    );
  }

  private int EnsureSiblingLayer(Layer sourceLayer, string targetLeafName, Color layerColor)
  {
    string targetFullPath = BuildSiblingLayerFullPath(sourceLayer, targetLeafName);

    int existingIndex = RhinoDocument.Layers.FindByFullPath(targetFullPath, -1);
    if (existingIndex >= 0)
      return existingIndex;

    Layer newLayer = new Layer();
    newLayer.Name = targetLeafName;
    newLayer.Color = layerColor;
    newLayer.ParentLayerId = sourceLayer.ParentLayerId;

    return RhinoDocument.Layers.Add(newLayer);
  }

  private string BuildSiblingLayerFullPath(Layer sourceLayer, string targetLeafName)
  {
    string fullPath = sourceLayer.FullPath;
    string separator = Rhino.RhinoMath.UnsetValue.ToString();

    string[] parts = fullPath.Split(new string[] { "::" }, StringSplitOptions.None);
    if (parts.Length <= 1)
      return targetLeafName;

    string[] parentParts = new string[parts.Length - 1];
    Array.Copy(parts, parentParts, parts.Length - 1);

    return string.Join("::", parentParts) + "::" + targetLeafName;
  }

  private Layer ResolveLayer(object input)
  {
    object obj = Unwrap(input);

    if (obj is Layer l)
      return l;

    string name = obj as string;
    if (string.IsNullOrWhiteSpace(name))
      return null;

    int idx = RhinoDocument.Layers.FindByFullPath(name, -1);
    if (idx >= 0)
      return RhinoDocument.Layers[idx];

    for (int i = 0; i < RhinoDocument.Layers.Count; i++)
    {
      Layer lyr = RhinoDocument.Layers[i];
      if (lyr != null && !lyr.IsDeleted &&
          string.Equals(lyr.Name, name, StringComparison.OrdinalIgnoreCase))
      {
        return lyr;
      }
    }

    return null;
  }

  private object Unwrap(object input)
  {
    object current = input;
    for (int i = 0; i < 3 && current != null; i++)
    {
      PropertyInfo prop = current.GetType().GetProperty("Value", BindingFlags.Instance | BindingFlags.Public);
      if (prop == null) break;

      object next = prop.GetValue(current, null);
      if (next == null || ReferenceEquals(next, current)) break;

      current = next;
    }
    return current;
  }
}
# ---------- end c_script_7 ----------

# ----
# 根据颜色筛选物件到图层
model_layer_9 = ModelLayer(<model layer referenced from the Rhino model>)
model_layer_10 = ModelLayer(<model layer referenced from the Rhino model>)
model_layer_11 = ModelLayer(Layer=model_layer_10)  # -> Layer, Name, Hidden, Locked, DisplayColour, Material, Linetype
model_layer_12 = ModelLayer(Layer=model_layer_9)  # -> Layer, Name, Hidden, Locked, DisplayColour, Material, Linetype
c_script_8 = CSharpScript(sourceLayerInput=model_layer_11.Name, glassLayerInput=model_layer_12.Name, apply=Button())  # -> out, a; inputs apply: Boolean; same code as c_script_7

# ----
# 调整图层打印线性
button_5 = Button()
model_layer_13 = ModelLayer(<model layer referenced from the Rhino model>)
model_layer_14 = ModelLayer(Layer=model_layer_13)  # -> Layer, Name, Hidden, Locked, DisplayColour, Material, Linetype
c_script_9 = CSharpScript(layerInput=model_layer_14.Name, printWidth=Slider(150, range=0..1000), apply=button_5)  # -> out, a; inputs printWidth: Double, apply: Boolean; same code as c_script

# ----
# 平面
number_slider_3 = Slider(150, range=0..1000)

# ----
# 调整图层打印线性
button_6 = Button()
model_layer_15 = ModelLayer(<model layer referenced from the Rhino model>)
model_layer_16 = ModelLayer(Layer=model_layer_15)  # -> Layer, Name, Hidden, Locked, DisplayColour, Material, Linetype
c_script_10 = CSharpScript(layerInput=model_layer_16.Name, printWidth=number_slider_3, apply=button_6)  # -> out, a; inputs printWidth: Double, apply: Boolean; same code as c_script

# ----
# 剖面（剖面线加粗）
number_slider_4 = Slider(150, range=0..1000)

# ----
# 调整图层打印线性
button_7 = Button()
model_layer_17 = ModelLayer(<model layer referenced from the Rhino model>)
model_layer_18 = ModelLayer(Layer=model_layer_17)  # -> Layer, Name, Hidden, Locked, DisplayColour, Material, Linetype
c_script_11 = CSharpScript(layerInput=model_layer_18.Name, printWidth=number_slider_4, apply=button_7)  # -> out, a; inputs printWidth: Double, apply: Boolean; same code as c_script

# ----
# gh里无法输入clippingpannel
model_layer_19 = ModelLayer(<model layer referenced from the Rhino model>)
model_layer_20 = ModelLayer(Layer=model_layer_19)  # -> Layer, Name, Hidden, Locked, DisplayColour, Material, Linetype
c_script_12 = CSharpScript(run=Button(), glassLayerInput=model_layer_20.Name, curveWidth=Slider(150, range=0..1000))  # -> out, a, b; inputs allWidth: Double, curveWidth: Double
# ---------- c_script_12: C# ----------
#region Usings
using System;
using System.Collections;
using System.Collections.Generic;
using System.Drawing;
using System.Reflection;

using Rhino;
using Rhino.DocObjects;
using Rhino.Geometry;
using Rhino.Input.Custom;
#endregion

public class Script_Instance : GH_ScriptInstance
{
  private void RunScript(
		object run,
		object clippingPlaneInput,
		object glassLayerInput,
		double allWidth,
		double curveWidth,
		ref object a,
		ref object b)
  {
    bool doRun = ToBool(run, false);
    if (!doRun)
    {
      a = "Idle. run 接 Button；clippingPlaneInput 接 Rhino 里的 ClippingPlane；glassLayerInput 接玻璃颜色来源图层。";
      b = null;
      return;
    }

    RhinoDoc doc = RhinoDocument ?? RhinoDoc.ActiveDoc;
    if (doc == null)
    {
      a = "找不到 Rhino 文档。";
      b = null;
      return;
    }

    Layer glassSourceLayer = ResolveLayer(doc, glassLayerInput);
    if (glassSourceLayer == null)
    {
      a = "Glass color layer not found.";
      b = null;
      return;
    }

    Color glassColor = glassSourceLayer.Color;
    double allWidthMm = Math.Max(0.0, allWidth);
    double curveWidthMm = Math.Max(0.0, curveWidth);

    List<Point3d> sectionPoints;
    List<Guid> clippingPlaneIds = ResolveClippingPlaneIds(doc, clippingPlaneInput, out sectionPoints);
    if (clippingPlaneIds.Count == 0)
    {
      a = "没有识别到有效的 ClippingPlane。请给 clippingPlaneInput 输入 Rhino 中已存在的 ClippingPlane 引用。";
      b = null;
      return;
    }

    b = sectionPoints;

    List<Guid> objectIdsBefore = GetExistingObjectIds(doc);

    doc.Objects.UnselectAll();
    int selected = SelectObjectsById(doc, clippingPlaneIds);
    if (selected == 0)
    {
      a = "没有成功选中 ClippingPlane。";
      return;
    }

    string command =
      "_ClippingDrawings " +
      "_Angle=0 " +
      "_PrintWidth=_ByLayer " +
      "_DisplayColor=_ByInputObject " +
      "_ShowHatch=_Yes " +
      "_ShowSolid=_Yes " +
      "_AddBackground=_Yes " +
      "_Projection=_Parallel " +
      "_AddHidden=_No " +
      "_AddSilhouette=_Yes " +
      "_ShowLabel=_Yes " +
      "_LabelStyle=_Dot " +
      "_ApplyToAll=_No " +
      "_Pause " +
      "_Enter";

    bool result = RhinoApp.RunScript(command, true);

    doc.Objects.UnselectAll();
    doc.Views.Redraw();

    List<Guid> newObjectIds = GetNewObjectIds(doc, objectIdsBefore);

    int foundAll;
    int changedAllLayers;
    int foundCurve;
    int changedCurveLayers;
    int resetObjectsToByLayer;
    int hiddenSolidLayers;
    int movedGlassObjects;
    int changedGlassLayers;
    List<string> glassLayerPaths;

    ApplyLayerRulesToNewDrawing(
      doc,
      newObjectIds,
      glassColor,
      allWidthMm,
      curveWidthMm,
      out foundAll,
      out changedAllLayers,
      out foundCurve,
      out changedCurveLayers,
      out resetObjectsToByLayer,
      out hiddenSolidLayers,
      out movedGlassObjects,
      out changedGlassLayers,
      out glassLayerPaths
    );

    doc.Views.Redraw();

    string glassLayerSummary = glassLayerPaths.Count > 0
      ? string.Join(", ", glassLayerPaths.ToArray())
      : "无";

    a =
      (result ? "完成。已创建 ClippingDrawing。\n" : "ClippingDrawings 命令没有成功完成，请查看 Rhino 命令行历史。\n") +
      "剖面点数量：" + sectionPoints.Count + "\n" +
      "本次新对象数：" + newObjectIds.Count + "\n" +
      "普通图层目标线宽：" + allWidthMm.ToString("0.###") + " mm\n" +
      "Curve 图层目标线宽：" + curveWidthMm.ToString("0.###") + " mm\n" +
      "普通图层：找到 " + foundAll + "，修改 " + changedAllLayers + "\n" +
      "Curve 图层：找到 " + foundCurve + "，修改 " + changedCurveLayers + "\n" +
      "对象打印线宽设为 ByLayer 数：" + resetObjectsToByLayer + "\n" +
      "隐藏 Solid 图层数：" + hiddenSolidLayers + "\n" +
      "玻璃物件移动数：" + movedGlassObjects + "\n" +
      "玻璃图层修改数：" + changedGlassLayers + "\n" +
      "玻璃目标图层：" + glassLayerSummary;
  }

  private static void ApplyLayerRulesToNewDrawing(
    RhinoDoc doc,
    List<Guid> newObjectIds,
    Color glassColor,
    double allWidthMm,
    double curveWidthMm,
    out int foundAll,
    out int changedAllLayers,
    out int foundCurve,
    out int changedCurveLayers,
    out int resetObjectsToByLayer,
    out int hiddenSolidLayers,
    out int movedGlassObjects,
    out int changedGlassLayers,
    out List<string> glassLayerPaths)
  {
    foundAll = 0;
    changedAllLayers = 0;
    foundCurve = 0;
    changedCurveLayers = 0;
    resetObjectsToByLayer = 0;
    hiddenSolidLayers = 0;
    movedGlassObjects = 0;
    changedGlassLayers = 0;
    glassLayerPaths = new List<string>();

    HashSet<int> touchedLayerIndexes = new HashSet<int>();
    HashSet<int> hiddenSolidLayerIndexes = new HashSet<int>();
    HashSet<int> touchedGlassLayerIndexes = new HashSet<int>();

    foreach (Guid objectId in newObjectIds)
    {
      RhinoObject obj = doc.Objects.FindId(objectId);
      if (obj == null || obj.IsDeleted)
        continue;

      Layer layer = doc.Layers[obj.Attributes.LayerIndex];
      if (layer == null)
        continue;

      bool isCurveLayer = IsCurveLayer(layer);
      bool isSolidLayer = IsSolidLayer(layer);
      double targetWidth = isCurveLayer ? curveWidthMm : allWidthMm;

      if (!touchedLayerIndexes.Contains(layer.Index))
      {
        touchedLayerIndexes.Add(layer.Index);

        if (isCurveLayer)
          foundCurve++;
        else
          foundAll++;

        Layer layerCopy = new Layer();
        layerCopy.CopyAttributesFrom(layer);
        layerCopy.PlotWeight = targetWidth;

        bool layerOk = doc.Layers.Modify(layerCopy, layer.Id, true);
        if (layerOk)
        {
          if (isCurveLayer)
            changedCurveLayers++;
          else
            changedAllLayers++;
        }
      }

      if (isSolidLayer && !hiddenSolidLayerIndexes.Contains(layer.Index))
      {
        hiddenSolidLayerIndexes.Add(layer.Index);

        Layer hideLayerCopy = new Layer();
        hideLayerCopy.CopyAttributesFrom(layer);
        hideLayerCopy.IsVisible = false;

        bool hideOk = doc.Layers.Modify(hideLayerCopy, layer.Id, true);
        if (hideOk)
          hiddenSolidLayers++;
      }

      Color objColor = obj.Attributes.DrawColor(doc);

      ObjectAttributes attr = obj.Attributes.Duplicate();
      attr.PlotWeightSource = ObjectPlotWeightSource.PlotWeightFromLayer;

      if (isCurveLayer && objColor.ToArgb() == glassColor.ToArgb())
      {
        int glassLayerIndex = EnsureSiblingLayer(doc, layer, "玻璃", glassColor, curveWidthMm);
        if (glassLayerIndex >= 0)
        {
          attr.LayerIndex = glassLayerIndex;
          movedGlassObjects++;

          if (!touchedGlassLayerIndexes.Contains(glassLayerIndex))
          {
            touchedGlassLayerIndexes.Add(glassLayerIndex);

            Layer glassLayer = doc.Layers[glassLayerIndex];
            if (glassLayer != null && !glassLayerPaths.Contains(glassLayer.FullPath))
              glassLayerPaths.Add(glassLayer.FullPath);

            changedGlassLayers++;
          }
        }
      }

      bool objOk = doc.Objects.ModifyAttributes(obj, attr, true);
      if (objOk)
        resetObjectsToByLayer++;
    }
  }

  private static int EnsureSiblingLayer(
    RhinoDoc doc,
    Layer sourceLayer,
    string targetLeafName,
    Color layerColor,
    double plotWeightMm)
  {
    string targetFullPath = BuildSiblingLayerFullPath(sourceLayer, targetLeafName);

    int existingIndex = doc.Layers.FindByFullPath(targetFullPath, -1);
    if (existingIndex >= 0)
    {
      Layer existing = doc.Layers[existingIndex];
      Layer existingCopy = new Layer();
      existingCopy.CopyAttributesFrom(existing);
      existingCopy.Color = layerColor;
      existingCopy.PlotWeight = plotWeightMm;
      doc.Layers.Modify(existingCopy, existing.Id, true);
      return existingIndex;
    }

    Layer newLayer = new Layer();
    newLayer.Name = targetLeafName;
    newLayer.Color = layerColor;
    newLayer.ParentLayerId = sourceLayer.ParentLayerId;
    newLayer.PlotWeight = plotWeightMm;

    return doc.Layers.Add(newLayer);
  }

  private static string BuildSiblingLayerFullPath(Layer sourceLayer, string targetLeafName)
  {
    string fullPath = sourceLayer.FullPath ?? sourceLayer.Name ?? "";

    string[] parts = fullPath.Split(new string[] { "::" }, StringSplitOptions.None);
    if (parts.Length <= 1)
      return targetLeafName;

    string[] parentParts = new string[parts.Length - 1];
    Array.Copy(parts, parentParts, parts.Length - 1);

    return string.Join("::", parentParts) + "::" + targetLeafName;
  }

  private static bool IsCurveLayer(Layer layer)
  {
    if (layer == null)
      return false;

    string name = layer.Name ?? "";
    string fullPath = layer.FullPath ?? name;

    return name.IndexOf("Curve", StringComparison.OrdinalIgnoreCase) >= 0
      || fullPath.IndexOf("Curve", StringComparison.OrdinalIgnoreCase) >= 0
      || name.IndexOf("曲线", StringComparison.OrdinalIgnoreCase) >= 0
      || fullPath.IndexOf("曲线", StringComparison.OrdinalIgnoreCase) >= 0;
  }

  private static bool IsSolidLayer(Layer layer)
  {
    if (layer == null)
      return false;

    string name = layer.Name ?? "";
    string fullPath = layer.FullPath ?? name;

    return name.IndexOf("Solid", StringComparison.OrdinalIgnoreCase) >= 0
      || fullPath.IndexOf("Solid", StringComparison.OrdinalIgnoreCase) >= 0
      || name.IndexOf("实体", StringComparison.OrdinalIgnoreCase) >= 0
      || fullPath.IndexOf("实体", StringComparison.OrdinalIgnoreCase) >= 0;
  }

  private static List<Guid> GetExistingObjectIds(RhinoDoc doc)
  {
    List<Guid> ids = new List<Guid>();

    ObjectEnumeratorSettings settings = new ObjectEnumeratorSettings();
    settings.HiddenObjects = true;
    settings.LockedObjects = true;
    settings.NormalObjects = true;
    settings.IncludeGrips = false;
    settings.IncludeLights = false;

    foreach (RhinoObject obj in doc.Objects.GetObjectList(settings))
    {
      if (obj != null && !ids.Contains(obj.Id))
        ids.Add(obj.Id);
    }

    return ids;
  }

  private static List<Guid> GetNewObjectIds(RhinoDoc doc, List<Guid> beforeIds)
  {
    List<Guid> ids = new List<Guid>();

    ObjectEnumeratorSettings settings = new ObjectEnumeratorSettings();
    settings.HiddenObjects = true;
    settings.LockedObjects = true;
    settings.NormalObjects = true;
    settings.IncludeGrips = false;
    settings.IncludeLights = false;

    foreach (RhinoObject obj in doc.Objects.GetObjectList(settings))
    {
      if (obj == null)
        continue;

      if (beforeIds.Contains(obj.Id))
        continue;

      if (!ids.Contains(obj.Id))
        ids.Add(obj.Id);
    }

    return ids;
  }

  private static int SelectObjectsById(RhinoDoc doc, IEnumerable<Guid> ids)
  {
    int count = 0;

    foreach (Guid id in ids)
    {
      RhinoObject obj = doc.Objects.FindId(id);
      if (obj == null)
        continue;

      obj.Select(true);
      count++;
    }

    doc.Views.Redraw();
    return count;
  }

  private static List<Guid> ResolveClippingPlaneIds(RhinoDoc doc, object input, out List<Point3d> points)
  {
    points = new List<Point3d>();
    List<Guid> ids = new List<Guid>();
    List<object> items = new List<object>();

    FlattenInput(input, items);

    foreach (object item in items)
    {
      object obj = Unwrap(item);
      Guid id = Guid.Empty;
      RhinoObject rhObj = null;

      if (obj is Guid)
      {
        id = (Guid)obj;
        rhObj = doc.Objects.FindId(id);
      }
      else if (obj is RhinoObject)
      {
        rhObj = obj as RhinoObject;
        if (rhObj != null) id = rhObj.Id;
      }
      else if (obj != null)
      {
        PropertyInfo idProp = obj.GetType().GetProperty("ObjectId");
        if (idProp != null)
        {
          object idValue = idProp.GetValue(obj, null);
          if (idValue is Guid)
          {
            id = (Guid)idValue;
            rhObj = doc.Objects.FindId(id);
          }
        }
      }

      if (rhObj == null || !(rhObj.Geometry is ClippingPlaneSurface))
        continue;

      if (!ids.Contains(id))
        ids.Add(id);

      ClippingPlaneSurface cps = rhObj.Geometry as ClippingPlaneSurface;
      Plane plane;
      if (cps != null && cps.TryGetPlane(out plane))
        points.Add(plane.Origin);
    }

    return ids;
  }

  private static void FlattenInput(object input, List<object> items)
  {
    if (input == null)
      return;

    object unwrapped = Unwrap(input);
    if (unwrapped == null)
      return;

    if (unwrapped is string)
    {
      items.Add(unwrapped);
      return;
    }

    IEnumerable enumerable = unwrapped as IEnumerable;
    if (enumerable != null && !(unwrapped is RhinoObject))
    {
      foreach (object item in enumerable)
        FlattenInput(item, items);
      return;
    }

    items.Add(unwrapped);
  }

  private static Layer ResolveLayer(RhinoDoc doc, object input)
  {
    object obj = Unwrap(input);

    if (obj is Layer)
      return obj as Layer;

    string name = obj as string;
    if (string.IsNullOrWhiteSpace(name))
      return null;

    int idx = doc.Layers.FindByFullPath(name, -1);
    if (idx >= 0)
      return doc.Layers[idx];

    for (int i = 0; i < doc.Layers.Count; i++)
    {
      Layer lyr = doc.Layers[i];
      if (lyr != null && !lyr.IsDeleted &&
          string.Equals(lyr.Name, name, StringComparison.OrdinalIgnoreCase))
      {
        return lyr;
      }
    }

    return null;
  }

  private static object Unwrap(object input)
  {
    object current = input;

    for (int i = 0; i < 4 && current != null; i++)
    {
      PropertyInfo prop = current.GetType().GetProperty("Value", BindingFlags.Instance | BindingFlags.Public);
      if (prop == null) break;

      object next = prop.GetValue(current, null);
      if (next == null || ReferenceEquals(next, current)) break;

      current = next;
    }

    return current;
  }

  private static bool ToBool(object value, bool fallback)
  {
    if (value == null)
      return fallback;

    if (value is bool)
      return (bool)value;

    bool parsed;
    if (bool.TryParse(value.ToString(), out parsed))
      return parsed;

    return fallback;
  }
}
# ---------- end c_script_12 ----------
