# Grasshopper definition dimension.gh (Grasshopper 1.0.8)

dimensionlinegap = Slider(2603.1, range=0..5000)
axisdimensions = Slider(3.3, range=0..10)
dimensiontextheight = Slider(270.66, range=0..500)
dimensionobjectdistance = Slider(2238.7, range=0..5000)
dimensions = CSharpScript(
    DimensionTextHeight=axisdimensions,
    DimensionModelSpaceScale=dimensiontextheight,
    DimensionObjectDistance=dimensionobjectdistance,
    DimensionLineGap=dimensionlinegap)  # -> out, AdjustedDimensions, Log; inputs AxisDimensions: list
# ---------- dimensions: C# ----------
#region Usings
using System;
using System.Collections;
using System.Collections.Generic;
using System.Linq;
using System.Reflection;

using Rhino;
using Rhino.Geometry;
using Rhino.DocObjects;

using Grasshopper;
using Grasshopper.Kernel;
using Grasshopper.Kernel.Data;
using Grasshopper.Kernel.Types;
#endregion

public class Script_Instance : GH_ScriptInstance
{
    private void RunScript(
		List<object> AxisDimensions,
		object DimensionTextHeight,
		object DimensionModelSpaceScale,
		object DimensionObjectDistance,
		object DimensionLineGap,
		ref object AdjustedDimensions,
		ref object Log)
    {
        double dimTextHeight;
        bool hasDimTextHeight = TryDouble(DimensionTextHeight, out dimTextHeight) && dimTextHeight > 0.0;

        double dimScale;
        bool hasDimScale = TryDouble(DimensionModelSpaceScale, out dimScale) && dimScale > 0.0;

        double objectDistance;
        bool hasObjectDistance = TryDouble(DimensionObjectDistance, out objectDistance) && objectDistance >= 0.0;

        double lineGap;
        bool hasLineGap = TryDouble(DimensionLineGap, out lineGap) && lineGap >= 0.0;

        List<LinearDimension> source = CollectDimensions(AxisDimensions);
        List<LinearDimension> dims = RebuildDimensions(
            source,
            hasDimTextHeight,
            dimTextHeight,
            hasDimScale,
            dimScale,
            hasObjectDistance,
            objectDistance,
            hasLineGap,
            lineGap);

        AdjustedDimensions = dims;

        var report = new List<string>();
        report.Add("Source dimensions: " + source.Count);
        report.Add("Adjusted dimensions: " + dims.Count);
        if (hasDimTextHeight)
            report.Add("Dimension text height: " + dimTextHeight);
        if (hasDimScale)
            report.Add("Dimension model space scale: " + dimScale);
        if (hasObjectDistance)
            report.Add("Dimension object distance: " + objectDistance);
        if (hasLineGap)
            report.Add("Dimension line gap: " + lineGap);
        Log = string.Join("\n", report);
    }

    private static List<LinearDimension> RebuildDimensions(
        List<LinearDimension> source,
        bool hasHeight,
        double height,
        bool hasScale,
        double scale,
        bool hasObjectDistance,
        double objectDistance,
        bool hasLineGap,
        double lineGap)
    {
        var infos = new List<DimensionInfo>();
        DimensionStyle fallbackStyle = RhinoDoc.ActiveDoc != null ? RhinoDoc.ActiveDoc.DimStyles.Current : null;

        foreach (LinearDimension dim in source)
        {
            if (dim == null)
                continue;

            Point3d p1;
            Point3d p2;
            Point3d dimPoint;
            if (!TryGetDimensionPoints(dim, out p1, out p2, out dimPoint))
                continue;

            Point3d mid = (p1 + p2) * 0.5;
            double distance = dimPoint.DistanceTo(mid);
            double spanLength = p1.DistanceTo(p2);
            if (distance <= 1e-9 || spanLength <= 1e-9)
                continue;

            infos.Add(new DimensionInfo
            {
                Source = dim,
                P1 = p1,
                P2 = p2,
                Mid = mid,
                DimPoint = dimPoint,
                Distance = distance,
                SpanLength = spanLength,
                OutsideDirection = dimPoint - mid,
                DimDirection = p2 - p1,
                Style = GetDimensionStyle(dim, fallbackStyle)
            });
        }

        if (infos.Count == 0)
            return new List<LinearDimension>();

        foreach (DimensionInfo info in infos)
        {
            if (!info.OutsideDirection.Unitize() || !info.DimDirection.Unitize())
                info.IsValid = false;
            else
                info.IsValid = true;
        }

        infos = infos.Where(x => x.IsValid).ToList();
        if (infos.Count == 0)
            return new List<LinearDimension>();

        double baseDistance = hasObjectDistance ? objectDistance : infos.Min(x => x.Distance);
        HashSet<DimensionInfo> outerInfos = ResolveOuterDimensions(infos);

        var rebuilt = new List<LinearDimension>();
        foreach (DimensionInfo info in infos)
        {
            double targetDistance = baseDistance;
            if (outerInfos.Contains(info))
                targetDistance = hasLineGap ? baseDistance + lineGap : info.Distance;
            else if (!hasObjectDistance)
                targetDistance = info.Distance;

            LinearDimension rebuiltDim = CreateRebuiltDimension(
                info,
                targetDistance,
                hasHeight ? height : GetDoubleProperty(info.Source, "TextHeight"),
                hasScale ? scale : GetDoubleProperty(info.Source, "DimensionScale"));

            if (rebuiltDim != null)
                rebuilt.Add(rebuiltDim);
        }

        return rebuilt;
    }

    private static HashSet<DimensionInfo> ResolveOuterDimensions(List<DimensionInfo> infos)
    {
        var outer = new HashSet<DimensionInfo>();
        if (infos == null || infos.Count < 2)
            return outer;

        double maxSpan = infos.Max(x => x.SpanLength);
        double tolerance = Math.Max(1e-6, maxSpan * 1e-4);
        foreach (DimensionInfo info in infos)
        {
            if (Math.Abs(info.SpanLength - maxSpan) <= tolerance)
                outer.Add(info);
        }

        if (outer.Count == infos.Count)
            outer.Clear();

        return outer;
    }

    private static LinearDimension CreateRebuiltDimension(
        DimensionInfo info,
        double targetDistance,
        double textHeight,
        double modelSpaceScale)
    {
        Point3d targetPoint = info.Mid + info.OutsideDirection * targetDistance;

        DimensionStyle style = info.Style != null ? info.Style.Duplicate() : new DimensionStyle();
        style.ArrowType1 = DimensionStyle.ArrowType.Tick;
        style.ArrowType2 = DimensionStyle.ArrowType.Tick;
        ApplyIntegerLengthPrecision(style);

        LinearDimension dim = CreateAlignedDimension(
            info.P1,
            info.P2,
            targetPoint,
            info.DimDirection,
            info.OutsideDirection,
            style,
            textHeight,
            modelSpaceScale);

        if (dim == null)
            return null;

        CopyDimensionDisplay(info.Source, dim);
        TrySet(dim, "TextFormula", "<>");
        TrySet(dim, "TextHeight", textHeight);
        TrySet(dim, "DimensionScale", modelSpaceScale);
        TrySet(dim, "ArrowType1", DimensionStyle.ArrowType.Tick);
        TrySet(dim, "ArrowType2", DimensionStyle.ArrowType.Tick);
        return dim;
    }

    private static void ApplyIntegerLengthPrecision(DimensionStyle style)
    {
        if (style == null)
            return;

        TrySet(style, "LengthResolution", 0);
        TrySet(style, "AlternateLengthResolution", 0);
        TrySet(style, "PrimaryLengthResolution", 0);
    }

    private static bool TryGetDimensionPoints(LinearDimension dim, out Point3d p1, out Point3d p2, out Point3d dimPoint)
    {
        p1 = Point3d.Unset;
        p2 = Point3d.Unset;
        dimPoint = Point3d.Unset;

        if (dim == null)
            return false;

        foreach (MethodInfo method in typeof(LinearDimension).GetMethods(BindingFlags.Public | BindingFlags.Instance))
        {
            if (method.Name != "Get3dPoints")
                continue;

            ParameterInfo[] ps = method.GetParameters();
            if (ps.Length < 5)
                continue;

            object[] args = new object[ps.Length];
            for (int i = 0; i < args.Length; i++)
                args[i] = Point3d.Unset;

            try
            {
                object result = method.Invoke(dim, args);
                if (result is bool && !(bool)result)
                    continue;

                p1 = (Point3d)args[0];
                p2 = (Point3d)args[1];
                dimPoint = (Point3d)args[4];
                return p1.IsValid && p2.IsValid && dimPoint.IsValid;
            }
            catch
            {
            }
        }

        return false;
    }

    private static LinearDimension CreateAlignedDimension(
        Point3d p1,
        Point3d p2,
        Point3d dimPoint,
        Vector3d dimDirection,
        Vector3d outsideDirection,
        DimensionStyle dimStyle,
        double textHeight,
        double modelSpaceScale)
    {
        if (!dimDirection.Unitize())
            return null;

        if (!outsideDirection.Unitize())
            return null;

        if (Math.Abs(Vector3d.Multiply(dimDirection, outsideDirection)) > 0.999)
            return null;

        Plane dimPlane = new Plane(dimPoint, dimDirection, outsideDirection);
        LinearDimension dim = null;
        try
        {
            dim = LinearDimension.Create(
                AnnotationType.Aligned,
                dimStyle,
                dimPlane,
                dimDirection,
                p1,
                p2,
                dimPoint,
                0.0);
        }
        catch
        {
            dim = null;
        }

        if (dim != null)
        {
            TrySet(dim, "TextHeight", textHeight);
            TrySet(dim, "DimensionScale", modelSpaceScale);
            TrySet(dim, "DrawForward", true);
        }

        return dim;
    }

    private static DimensionStyle GetDimensionStyle(LinearDimension dim, DimensionStyle fallback)
    {
        if (dim == null || RhinoDoc.ActiveDoc == null)
            return fallback;

        PropertyInfo styleIdProperty = dim.GetType().GetProperty("DimensionStyleId");
        if (styleIdProperty == null || !styleIdProperty.CanRead || styleIdProperty.PropertyType != typeof(Guid))
            return fallback;

        try
        {
            Guid styleId = (Guid)styleIdProperty.GetValue(dim, null);
            DimensionStyle style = RhinoDoc.ActiveDoc.DimStyles.FindId(styleId);
            return style ?? fallback;
        }
        catch
        {
            return fallback;
        }
    }

    private static double GetDoubleProperty(object target, string propertyName)
    {
        if (target == null)
            return 0.0;

        PropertyInfo p = target.GetType().GetProperty(propertyName);
        if (p == null || !p.CanRead)
            return 0.0;

        try
        {
            object value = p.GetValue(target, null);
            if (value is double)
                return (double)value;
        }
        catch
        {
        }

        return 0.0;
    }

    private static List<LinearDimension> CollectDimensions(object input)
    {
        var output = new List<LinearDimension>();
        AddDimensionRecursive(input, output);
        return output;
    }

    private static void AddDimensionRecursive(object input, List<LinearDimension> output)
    {
        if (input == null)
            return;

        LinearDimension dim = TryGetDimension(input);
        if (dim != null)
        {
            output.Add(dim);
            return;
        }

        foreach (object item in EnumerateInput(input))
            AddDimensionRecursive(item, output);
    }

    private static IEnumerable<object> EnumerateInput(object input)
    {
        IGH_Structure tree = input as IGH_Structure;
        if (tree != null)
        {
            for (int i = 0; i < tree.PathCount; i++)
            {
                IList branch = tree.get_Branch(tree.Paths[i]);
                foreach (object item in branch)
                    yield return item;
            }
            yield break;
        }

        IEnumerable enumerable = input as IEnumerable;
        if (enumerable == null || input is string)
            yield break;

        foreach (object item in enumerable)
            yield return item;
    }

    private static LinearDimension TryGetDimension(object input)
    {
        if (input == null)
            return null;

        LinearDimension dim = input as LinearDimension;
        if (dim != null)
            return dim;

        RhinoObject obj = input as RhinoObject;
        if (obj != null)
            return obj.Geometry as LinearDimension;

        GH_ObjectWrapper wrapper = input as GH_ObjectWrapper;
        if (wrapper != null && wrapper.Value != null)
            return TryGetDimension(wrapper.Value);

        IGH_Goo goo = input as IGH_Goo;
        if (goo != null)
        {
            LinearDimension castDim;
            if (goo.CastTo<LinearDimension>(out castDim) && castDim != null)
                return castDim;
        }

        return null;
    }

    private static bool TryDouble(object value, out double result)
    {
        result = 0.0;

        if (value == null)
            return false;

        if (value is double)
        {
            result = (double)value;
            return true;
        }

        if (value is int)
        {
            result = (int)value;
            return true;
        }

        GH_Number n = value as GH_Number;
        if (n != null)
        {
            result = n.Value;
            return true;
        }

        GH_Integer i = value as GH_Integer;
        if (i != null)
        {
            result = i.Value;
            return true;
        }

        GH_ObjectWrapper wrapper = value as GH_ObjectWrapper;
        if (wrapper != null && wrapper.Value != null)
            return TryDouble(wrapper.Value, out result);

        return double.TryParse(value.ToString(), out result);
    }

    private static void CopyDimensionDisplay(LinearDimension source, LinearDimension target)
    {
        if (source == null || target == null)
            return;

        CopyProperty(source, target, "DrawForward");
        CopyProperty(source, target, "TextGap");
    }

    private static void CopyProperty(object source, object target, string propertyName)
    {
        if (source == null || target == null)
            return;

        PropertyInfo sourceProperty = source.GetType().GetProperty(propertyName);
        PropertyInfo targetProperty = target.GetType().GetProperty(propertyName);
        if (sourceProperty == null || targetProperty == null || !sourceProperty.CanRead || !targetProperty.CanWrite)
            return;

        try
        {
            targetProperty.SetValue(target, sourceProperty.GetValue(source, null), null);
        }
        catch
        {
        }
    }

    private static void TrySet(object target, string propertyName, object value)
    {
        if (target == null)
            return;

        PropertyInfo p = target.GetType().GetProperty(propertyName);
        if (p == null || !p.CanWrite)
            return;

        try
        {
            p.SetValue(target, value, null);
        }
        catch
        {
        }
    }

    private class DimensionInfo
    {
        public LinearDimension Source;
        public Point3d P1;
        public Point3d P2;
        public Point3d Mid;
        public Point3d DimPoint;
        public Vector3d OutsideDirection;
        public Vector3d DimDirection;
        public double Distance;
        public double SpanLength;
        public DimensionStyle Style;
        public bool IsValid;
    }
}
# ---------- end dimensions ----------
