# Grasshopper definition 02 dimensions.gh (Grasshopper 1.0.8)

轴线外伸_mm = Slider(816, range=0..3000)
标注偏移_mm = Slider(1000, range=500..6000)
尺寸字高_mm = Slider(543, range=100..1200)
y轴间距_mm = Slider(8400, range=1000..30000)
x轴间距_mm = Slider(8100, range=1000..30000)
出图比例_1 = Slider(200, range=50..500)
常用比例参考 = Panel("""常用建筑比例 (可调中间值):
━━━━━━━━━━━━━━━━━━━
  1:50   1:75  →1:100←  1:125
  1:150  1:200  1:250  1:300
  1:400  1:500
━━━━━━━━━━━━━━━━━━━
当前: 1:130 (拖动滑块设置)""")
y跨数 = Slider(4, range=1..20)
x跨数 = Slider(3, range=1..20)
axis_annotation = CSharpScript(
    xSpans=x轴间距_mm,
    ySpans=y轴间距_mm,
    extension=轴线外伸_mm,
    dimOffset=标注偏移_mm,
    dimTextHeight=尺寸字高_mm,
    xCount=x跨数,
    yCount=y跨数,
    drawingScale=出图比例_1)  # -> out, dimensionLinesOut, dimensionTextsOut, reportOut
# ---------- axis_annotation: C# ----------
// Grasshopper Script Instance
#region Usings
using System;
using System.Linq;
using System.Collections;
using System.Collections.Generic;
using System.Drawing;

using Rhino;
using Rhino.Geometry;

using Grasshopper;
using Grasshopper.Kernel;
using Grasshopper.Kernel.Data;
using Grasshopper.Kernel.Types;
#endregion

public class Script_Instance : GH_ScriptInstance
{
    #region Notes
    /* 
      Members:
        RhinoDoc RhinoDocument
        GH_Document GrasshopperDocument
        IGH_Component Component
        int Iteration

      Methods (Virtual & overridable):
        Print(string text)
        Print(string format, params object[] args)
        Reflect(object obj)
        Reflect(object obj, string method_name)
    */
    #endregion

    private void RunScript(
		object xSpans,
		object ySpans,
		object extension,
		object dimOffset,
		object dimTextHeight,
		object xCount,
		object yCount,
		object drawingScale,
		ref object dimensionLinesOut,
		ref object dimensionTextsOut,
		ref object reportOut)
    {
    double ToDoubleOrDefault(object value, double fallback)
    {
      if (value == null) return fallback;
      double parsed;
      return double.TryParse(value.ToString(), System.Globalization.NumberStyles.Float, System.Globalization.CultureInfo.InvariantCulture, out parsed) ? parsed : fallback;
    }
    
    int ToIntOrDefault(object value, int fallback)
    {
      if (value == null) return fallback;
      int parsed;
      return int.TryParse(value.ToString(), out parsed) ? parsed : fallback;
    }
    
    string xSpansStr = xSpans == null ? string.Empty : xSpans.ToString();
    string ySpansStr = ySpans == null ? string.Empty : ySpans.ToString();
    double ext = ToDoubleOrDefault(extension, 0.0);
    double dimOff = ToDoubleOrDefault(dimOffset, 600.0);
    double dimH = ToDoubleOrDefault(dimTextHeight, 350.0);
    int xCnt = ToIntOrDefault(xCount, 1);
    int yCnt = ToIntOrDefault(yCount, 1);
    double scale = ToDoubleOrDefault(drawingScale, 100.0);
    scale = Math.Max(10.0, Math.Min(1000.0, scale));
    double scaleFactor = scale / 100.0;
    xCnt = Math.Max(1, Math.Min(20, xCnt));
    yCnt = Math.Max(1, Math.Min(20, yCnt));
    
    List<double> ParseNumbers(string raw)
    {
      var vals = new List<double>();
      if (string.IsNullOrWhiteSpace(raw)) return vals;
      var parts = raw.Split(new char[] {',', ';', ' '}, StringSplitOptions.RemoveEmptyEntries);
      foreach (var p in parts) { double v; if (double.TryParse(p, out v) && v > 0.0) vals.Add(v); }
      return vals;
    }
    
    TextEntity MakeText(string text, Plane plane, double height, TextJustification just)
    {
      var te = new TextEntity();
      te.Plane = plane; te.PlainText = text;
      te.TextHeight = height / scaleFactor;
      te.DimensionScale = scaleFactor;
      te.Justification = just;
      return te;
    }
    
    string FormatDim(double v)
    {
      var r = Math.Round(v, 3);
      if (Math.Abs(r - Math.Round(r)) < 0.0001) return ((int)Math.Round(r)).ToString();
      return r.ToString("0.###");
    }
    
    var xSpanValues = ParseNumbers(xSpansStr);
    var ySpanValues = ParseNumbers(ySpansStr);
    
    if (xSpanValues.Count == 1 && xCnt > 1) { double v = xSpanValues[0]; xSpanValues = Enumerable.Repeat(v, xCnt).ToList(); }
    if (ySpanValues.Count == 1 && yCnt > 1) { double v = ySpanValues[0]; ySpanValues = Enumerable.Repeat(v, yCnt).ToList(); }
    
    var report = new List<string>();
    var dimLines = new List<Line>();
    var dimTexts = new List<TextEntity>();
    
    if (xSpanValues.Count == 0 || ySpanValues.Count == 0)
    {
      report.Add("xSpans 和 ySpans 不能为空。");
      dimensionLinesOut = dimLines; dimensionTextsOut = dimTexts; reportOut = string.Join("\n", report); return;
    }
    
    ext = Math.Max(0.0, ext);
    dimOff = Math.Max(200.0, dimOff);
    dimH = Math.Max(50.0, dimH);
    
    var xCoords = new List<double>(); xCoords.Add(0.0);
    var yCoords = new List<double>(); yCoords.Add(0.0);
    for (int i = 0; i < xSpanValues.Count; i++) xCoords.Add(xCoords[i] + xSpanValues[i]);
    for (int i = 0; i < ySpanValues.Count; i++) yCoords.Add(yCoords[i] + ySpanValues[i]);
    double totalX = xCoords[xCoords.Count - 1];
    double totalY = yCoords[yCoords.Count - 1];
    
    double tick = dimH * 0.85;
    double halfTick = tick * 0.5;
    double textGap = dimH;
    double spanGap = dimOff * 0.65;
    double totalGap = dimOff * 1.6;
    
    Action<double, double, double, bool> AddHDims = (yBase, yDim, textY, flipTick) =>
    {
      for (int i = 0; i < xSpanValues.Count; i++)
      {
        double x1 = xCoords[i], x2 = xCoords[i + 1], mid = 0.5 * (x1 + x2);
        dimLines.Add(new Line(x1, yBase, 0, x1, yDim, 0));
        dimLines.Add(new Line(x2, yBase, 0, x2, yDim, 0));
        dimLines.Add(new Line(x1, yDim, 0, x2, yDim, 0));
        double s = flipTick ? 1.0 : -1.0;
        dimLines.Add(new Line(x1 + halfTick, yDim + s * halfTick, 0, x1 - halfTick, yDim - s * halfTick, 0));
        dimLines.Add(new Line(x2 + halfTick, yDim + s * halfTick, 0, x2 - halfTick, yDim - s * halfTick, 0));
        var p = Plane.WorldXY; p.Origin = new Point3d(mid, textY, 0);
        dimTexts.Add(MakeText(FormatDim(xSpanValues[i]), p, dimH, TextJustification.MiddleCenter));
      }
      double totalMid = totalX * 0.5;
      double yB2 = flipTick ? totalY + dimOff + totalGap + ext : -(dimOff + totalGap + ext);
      double yD2 = flipTick ? yB2 + spanGap : yB2 - spanGap;
      double tY2 = yD2 + textGap;
      dimLines.Add(new Line(0, yB2, 0, 0, yD2, 0));
      dimLines.Add(new Line(totalX, yB2, 0, totalX, yD2, 0));
      dimLines.Add(new Line(0, yD2, 0, totalX, yD2, 0));
      double s2 = flipTick ? 1.0 : -1.0;
      dimLines.Add(new Line(halfTick, yD2 + s2 * halfTick, 0, -halfTick, yD2 - s2 * halfTick, 0));
      dimLines.Add(new Line(totalX + halfTick, yD2 + s2 * halfTick, 0, totalX - halfTick, yD2 - s2 * halfTick, 0));
      var p2 = Plane.WorldXY; p2.Origin = new Point3d(totalMid, tY2, 0);
      dimTexts.Add(MakeText(FormatDim(totalX), p2, dimH, TextJustification.MiddleCenter));
    };
    
    Action<double, double, double, bool> AddVDims = (xBase, xDim, textX, flipTick) =>
    {
      for (int i = 0; i < ySpanValues.Count; i++)
      {
        double y1 = yCoords[i], y2 = yCoords[i + 1], mid = 0.5 * (y1 + y2);
        dimLines.Add(new Line(xBase, y1, 0, xDim, y1, 0));
        dimLines.Add(new Line(xBase, y2, 0, xDim, y2, 0));
        dimLines.Add(new Line(xDim, y1, 0, xDim, y2, 0));
        double s = flipTick ? 1.0 : -1.0;
        dimLines.Add(new Line(xDim + s * halfTick, y1 + halfTick, 0, xDim - s * halfTick, y1 - halfTick, 0));
        dimLines.Add(new Line(xDim + s * halfTick, y2 + halfTick, 0, xDim - s * halfTick, y2 - halfTick, 0));
        var p = new Plane(new Point3d(textX, mid, 0), Vector3d.YAxis, Vector3d.XAxis);
        dimTexts.Add(MakeText(FormatDim(ySpanValues[i]), p, dimH, TextJustification.MiddleCenter));
      }
      double totalMid = totalY * 0.5;
      double xB2 = flipTick ? totalX + dimOff + totalGap + ext : -(dimOff + totalGap + ext);
      double xD2 = flipTick ? xB2 + spanGap : xB2 - spanGap;
      double tX2 = xD2 - textGap;
      dimLines.Add(new Line(xB2, 0, 0, xD2, 0, 0));
      dimLines.Add(new Line(xB2, totalY, 0, xD2, totalY, 0));
      dimLines.Add(new Line(xD2, 0, 0, xD2, totalY, 0));
      double s2 = flipTick ? 1.0 : -1.0;
      dimLines.Add(new Line(xD2 + s2 * halfTick, halfTick, 0, xD2 - s2 * halfTick, -halfTick, 0));
      dimLines.Add(new Line(xD2 + s2 * halfTick, totalY + halfTick, 0, xD2 - s2 * halfTick, totalY - halfTick, 0));
      var p2 = new Plane(new Point3d(tX2, totalMid, 0), Vector3d.YAxis, Vector3d.XAxis);
      dimTexts.Add(MakeText(FormatDim(totalY), p2, dimH, TextJustification.MiddleCenter));
    };
    
    double yBB = -(dimOff + ext);
    double yDB = yBB - spanGap;
    double tYB = yDB + textGap;
    AddHDims(yBB, yDB, tYB, false);
    
    double yBT = totalY + dimOff + ext;
    double yDT = yBT + spanGap;
    double tYT = yDT + textGap;
    AddHDims(yBT, yDT, tYT, true);
    
    double xBL = -(dimOff + ext);
    double xDL = xBL - spanGap;
    double tXL = xDL - textGap;
    AddVDims(xBL, xDL, tXL, false);
    
    double xBR = totalX + dimOff + ext;
    double xDR = xBR + spanGap;
    double tXR = xDR - textGap;
    AddVDims(xBR, xDR, tXR, true);
    
    report.Add("出图比例: 1:" + ((int)scale));
    report.Add("单位: mm");
    report.Add("X轴跨数: " + xSpanValues.Count);
    report.Add("Y轴跨数: " + ySpanValues.Count);
    report.Add("总宽: " + FormatDim(totalX));
    report.Add("总高: " + FormatDim(totalY));
    report.Add("尺寸线: " + dimLines.Count);
    report.Add("尺寸文字: " + dimTexts.Count);
    
    dimensionLinesOut = dimLines; dimensionTextsOut = dimTexts;
    reportOut = string.Join("\n", report);
}
}
# ---------- end axis_annotation ----------
