# Grasshopper definition axis.gh (Grasshopper 1.0.8)

xaxiscount = Slider(6, range=0..10)
yaxiscount = Slider(5, range=0..10)
xaveragespacing = Slider(8000, range=0..8000)
yaveragespacing = Slider(8000, range=0..8000)
bubblediameter = Slider(3085, range=0..5000)
axisangledeg = Slider(90, range=0..500)
axisextension = Slider(5000, range=0..5000)
leaderlength = Slider(9000, range=0..9000)
axis = CSharpScript(
    XAxisCount=xaxiscount,
    YAxisCount=yaxiscount,
    XAverageSpacing=xaveragespacing,
    YAverageSpacing=yaveragespacing,
    AxisAngleDeg=axisangledeg,
    BubbleDiameter=bubblediameter,
    AxisExtension=axisextension,
    LeaderLength=leaderlength)  # -> out, AxisLines, AxisBubble, AxisDimensions, AxisEndPoints, Log
# ---------- axis: C# ----------
#region Usings
using System;
using System.Linq;
using System.Collections;
using System.Collections.Generic;
using System.Reflection;
using System.Globalization;
using Grasshopper.Kernel.Data;

using Rhino;
using Rhino.Geometry;
using Rhino.DocObjects;

using Grasshopper;
using Grasshopper.Kernel;
using Grasshopper.Kernel.Types;
#endregion

public class Script_Instance : GH_ScriptInstance
{
  private void RunScript(
		object XAxisCount,
		object YAxisCount,
		object XAverageSpacing,
		object YAverageSpacing,
		object XSpacings,
		object YSpacings,
		object AxisAngleDeg,
		object BubbleDiameter,
		object AxisExtension,
		object LeaderLength,
		ref object AxisLines,
		ref object AxisBubble,
		ref object AxisDimensions,
		ref object AxisEndPoints,
		ref object Log)
  {
    var report = new List<string>();
    var result = new AxisGridResult();

    int xCount, yCount;
    double angleDeg, bubbleDiameter, axisExtension, leaderLength;

    if (!TryGetInt(XAxisCount, out xCount) || xCount < 1)
    {
      Log = "XAxisCount must be an integer >= 1.";
      return;
    }

    if (!TryGetInt(YAxisCount, out yCount) || yCount < 1)
    {
      Log = "YAxisCount must be an integer >= 1.";
      return;
    }

    if (!TryGetDouble(AxisAngleDeg, out angleDeg))
      angleDeg = 90.0;

    if (!TryGetDouble(BubbleDiameter, out bubbleDiameter) || bubbleDiameter <= 0.0)
      bubbleDiameter = 3000.0;

    if (!TryGetDouble(AxisExtension, out axisExtension) || axisExtension < 0.0)
      axisExtension = 3000.0;

    if (!TryGetDouble(LeaderLength, out leaderLength) || leaderLength < 0.0)
      leaderLength = 3000.0;

    List<double> xSpacings = ResolveSpacings(
      xCount,
      XAverageSpacing,
      XSpacings,
      "XSpacings",
      report);

    List<double> ySpacings = ResolveSpacings(
      yCount,
      YAverageSpacing,
      YSpacings,
      "YSpacings",
      report);

    if (xSpacings == null || ySpacings == null)
    {
      Log = string.Join("\n", report);
      return;
    }

    double angleRad = RhinoMath.ToRadians(angleDeg);
    if (Math.Abs(Math.Sin(angleRad)) < 1e-6)
    {
      report.Add("Axis angle cannot be 0 or 180 degrees.");
      Log = string.Join("\n", report);
      return;
    }

    var options = new GridOptions();
    options.AngleDeg = angleDeg;
    options.BubbleRadius = bubbleDiameter * 0.5;
    options.TextHeight = bubbleDiameter * 0.6;
    options.LeaderLength = leaderLength;
    options.AxisExtension = axisExtension;
    options.DimOffsetInner = 4500.0;
    options.DimOffsetOuter = 6500.0;
    options.DimensionTextHeight = 600.0;
    options.ModelSpaceScale = 1.0;

    report.Add("X axis count: " + xCount);
    report.Add("Y axis count: " + yCount);
    report.Add("Axis angle (deg): " + FormatDouble(angleDeg));
    report.Add("Bubble diameter: " + FormatDouble(bubbleDiameter));
    report.Add("Text height: " + FormatDouble(options.TextHeight));
    report.Add("Axis extension: " + FormatDouble(axisExtension));
    report.Add("Leader length: " + FormatDouble(leaderLength));
    report.Add("X spacings: " + string.Join(", ", xSpacings.Select(FormatDouble).ToArray()));
    report.Add("Y spacings: " + string.Join(", ", ySpacings.Select(FormatDouble).ToArray()));
    report.Add("AxisEndPoints branches: {0}=XStart, {1}=XEnd, {2}=YStart, {3}=YEnd");

    var dimStyle = RhinoDoc.ActiveDoc != null ? RhinoDoc.ActiveDoc.DimStyles.Current : null;

    Vector3d xDir = Vector3d.XAxis;
    Vector3d yDir = Vector3d.XAxis;
    yDir.Rotate(angleRad, Vector3d.ZAxis);

    Vector3d xOffsetDir = Vector3d.CrossProduct(Vector3d.ZAxis, xDir);
    Vector3d yOffsetDir = Vector3d.CrossProduct(Vector3d.ZAxis, yDir);

    if (!xOffsetDir.Unitize() || !yOffsetDir.Unitize())
    {
      Log = "Failed to compute offset directions.";
      return;
    }

    List<double> xStations = BuildStations(xCount, xSpacings);
    List<double> yStations = BuildStations(yCount, ySpacings);

    var xAxes = BuildAxisGroup(
      xStations, xDir, xOffsetDir, false, options, yStations, yDir, yOffsetDir, "A");
    var yAxes = BuildAxisGroup(
      yStations, yDir, yOffsetDir, true, options, xStations, xDir, xOffsetDir, "1");
    for (int i = 0; i < yAxes.Count; i++)
      yAxes[i].Label = NumberLabel("1", yAxes.Count - 1 - i);

    var endpointTree = new DataTree<Point3d>();
    AddAxisEndpointsToTree(endpointTree, xAxes, 0, 1);
    AddAxisEndpointsToTree(endpointTree, yAxes, 2, 3);

    foreach (var axis in xAxes.Concat(yAxes))
    {
      result.AxisLines.Add(axis.Extended.ToNurbsCurve());

      foreach (int side in new int[] { -1, 1 })
      {
        Point3d end = axis.GetSidePoint(side);
        Point3d leaderEnd = end + axis.Direction * side * options.LeaderLength;
        Point3d bubbleCenter = leaderEnd + axis.Direction * side * options.BubbleRadius;
        Plane bubblePlane = new Plane(bubbleCenter, Vector3d.XAxis, Vector3d.YAxis);
        Plane textPlane = new Plane(bubbleCenter, Vector3d.XAxis, Vector3d.YAxis);

        result.AxisBubbleCurves.Add(new LineCurve(end, leaderEnd));
        result.AxisBubbleCurves.Add(new Circle(bubblePlane, options.BubbleRadius).ToNurbsCurve());

        TextEntity text = AnnotationFactory.CreateText(
        axis.Label,
        textPlane,
        options.TextHeight,
        dimStyle,
        options.ModelSpaceScale);

        if (text != null)
          result.AxisBubbleTexts.Add(text);
      }
    }

    // 收集 X 和 Y 方向的标注
    var xDimensions = new List<LinearDimension>();
    var yDimensions = new List<LinearDimension>();
    BuildDimensions(xAxes, xOffsetDir, xDir, options, dimStyle, xDimensions);
    BuildDimensions(yAxes, yOffsetDir, yDir, options, dimStyle, yDimensions);

    // 构建数据树输出：分支0 = X向标注，分支1 = Y向标注
    var dimTree = new DataTree<LinearDimension>();
    dimTree.AddRange(xDimensions, new GH_Path(0));
    dimTree.AddRange(yDimensions, new GH_Path(1));
    AxisDimensions = dimTree;

    var axisBubbleTree = new DataTree<object>();
    GH_Path curvePath = new GH_Path(0);
    GH_Path textPath = new GH_Path(1);

    foreach (Curve curve in result.AxisBubbleCurves)
      axisBubbleTree.Add(curve, curvePath);

    foreach (TextEntity text in result.AxisBubbleTexts)
      axisBubbleTree.Add(text, textPath);

    report.Add("Done: axis lines " + result.AxisLines.Count
      + ", bubble curves " + result.AxisBubbleCurves.Count
      + ", bubble texts " + result.AxisBubbleTexts.Count
      + ", dimensions " + (xDimensions.Count + yDimensions.Count) + ".");
    report.Add("AxisBubble branches: {0}=Curves, {1}=Texts");

    AxisLines = result.AxisLines;
    AxisBubble = axisBubbleTree;
    AxisEndPoints = endpointTree;
    Log = string.Join("\n", report);
  }

  static List<double> ResolveSpacings(
    int count,
    object avgInput,
    object listInput,
    string name,
    List<string> report)
  {
    int spacingCount = Math.Max(0, count - 1);
    if (spacingCount == 0)
      return new List<double>();

    List<double> values = TryGetDoubleList(listInput);
    if (values != null && values.Count > 0)
    {
      if (values.Count != spacingCount)
      {
        report.Add(name + " count must be " + spacingCount + ", current " + values.Count + ".");
        return null;
      }

      if (values.Any(v => v <= 0))
      {
        report.Add(name + " values must all be > 0.");
        return null;
      }

      return values;
    }

    double avg;
    if (!TryGetDouble(avgInput, out avg) || avg <= 0)
    {
      report.Add(name + " average spacing must be > 0 when array input is empty.");
      return null;
    }

    return Enumerable.Repeat(avg, spacingCount).ToList();
  }

  static List<double> BuildStations(int count, List<double> spacings)
  {
    var stations = new List<double>();
    double s = 0.0;
    stations.Add(s);

    for (int i = 0; i < spacings.Count; i++)
    {
      s += spacings[i];
      stations.Add(s);
    }

    return stations;
  }

  static List<GridAxis> BuildAxisGroup(
    List<double> stations,
    Vector3d axisDir,
    Vector3d offsetDir,
    bool numberLabels,
    GridOptions options,
    List<double> otherStations,
    Vector3d otherAxisDir,
    Vector3d otherOffsetDir,
    string startLabel)
  {
    var axes = new List<GridAxis>();

    for (int i = 0; i < stations.Count; i++)
    {
      Point3d lineOrigin = Point3d.Origin + offsetDir * stations[i];

      var ts = new List<double>();
      for (int j = 0; j < otherStations.Count; j++)
      {
        Point3d otherOrigin = Point3d.Origin + otherOffsetDir * otherStations[j];
        double t;
        if (TryIntersect2D(lineOrigin, axisDir, otherOrigin, otherAxisDir, out t))
          ts.Add(t);
      }

      if (ts.Count == 0)
        continue;

      double minT = ts.Min();
      double maxT = ts.Max();

      Line refLine = new Line(
        lineOrigin + axisDir * minT,
        lineOrigin + axisDir * maxT);

      Line extLine = new Line(
        lineOrigin + axisDir * (minT - options.AxisExtension),
        lineOrigin + axisDir * (maxT + options.AxisExtension));

      axes.Add(new GridAxis
      {
        Index = i,
        Station = stations[i],
        Direction = axisDir,
        OffsetDirection = offsetDir,
        Reference = refLine,
        Extended = extLine,
        Label = numberLabels ? NumberLabel(startLabel, i) : LetterLabel(startLabel, i)
      });
    }

    return axes;
  }

  static void AddAxisEndpointsToTree(
    DataTree<Point3d> tree,
    List<GridAxis> axes,
    int startPathIndex,
    int endPathIndex)
  {
    GH_Path startPath = new GH_Path(startPathIndex);
    GH_Path endPath = new GH_Path(endPathIndex);

    foreach (GridAxis axis in axes)
    {
      tree.Add(axis.GetSidePoint(-1), startPath);
      tree.Add(axis.GetSidePoint(1), endPath);
    }
  }

  static void BuildDimensions(
    List<GridAxis> axes,
    Vector3d dimDirection,
    Vector3d outsideDirection,
    GridOptions options,
    DimensionStyle dimStyle,
    List<LinearDimension> targetList)
  {
    if (axes.Count < 2)
      return;

    foreach (int side in new int[] { -1, 1 })
    {
      for (int i = 0; i < axes.Count - 1; i++)
      {
        LinearDimension dim = CreateDimension(
          axes[i].GetSidePoint(side),
          axes[i + 1].GetSidePoint(side),
          dimDirection,
          outsideDirection * side,
          options.DimOffsetInner,
          options,
          dimStyle);
        if (dim != null) targetList.Add(dim);
      }

      LinearDimension outerDim = CreateDimension(
        axes.First().GetSidePoint(side),
        axes.Last().GetSidePoint(side),
        dimDirection,
        outsideDirection * side,
        options.DimOffsetOuter,
        options,
        dimStyle);
      if (outerDim != null) targetList.Add(outerDim);
    }
  }

  static LinearDimension CreateDimension(
    Point3d p1,
    Point3d p2,
    Vector3d dimDirection,
    Vector3d outsideDirection,
    double offset,
    GridOptions options,
    DimensionStyle dimStyle)
  {
    Point3d dimPoint = (p1 + p2) * 0.5 + outsideDirection * offset;

    LinearDimension dim = AnnotationFactory.CreateAlignedDimension(
      p1, p2, dimPoint,
      dimDirection,
      outsideDirection,
      dimStyle,
      options.DimensionTextHeight,
      options.ModelSpaceScale);

    return dim;
  }

  static bool TryIntersect2D(Point3d p1, Vector3d d1, Point3d p2, Vector3d d2, out double t)
  {
    t = 0.0;
    double det = d1.X * (-d2.Y) - d1.Y * (-d2.X);
    if (Math.Abs(det) < 1e-9)
      return false;

    double rx = p2.X - p1.X;
    double ry = p2.Y - p1.Y;
    t = (rx * (-d2.Y) - ry * (-d2.X)) / det;
    return true;
  }

  static bool TryGetInt(object value, out int result)
  {
    result = 0;
    double d;
    if (!TryGetDouble(value, out d))
      return false;
    result = (int)Math.Round(d);
    return true;
  }

  static bool TryGetDouble(object value, out double result)
  {
    result = 0.0;
    if (value == null) return false;

    if (value is double) { result = (double)value; return true; }
    if (value is int) { result = (int)value; return true; }

    GH_Number n = value as GH_Number;
    if (n != null) { result = n.Value; return true; }

    GH_Integer gi = value as GH_Integer;
    if (gi != null) { result = gi.Value; return true; }

    GH_ObjectWrapper w = value as GH_ObjectWrapper;
    if (w != null && w.Value != null) return TryGetDouble(w.Value, out result);

    IGH_Goo goo = value as IGH_Goo;
    if (goo != null)
    {
      double castDouble;
      if (goo.CastTo<double>(out castDouble))
      {
        result = castDouble;
        return true;
      }

      int castInt;
      if (goo.CastTo<int>(out castInt))
      {
        result = castInt;
        return true;
      }
    }

    string s = value as string;
    if (!string.IsNullOrWhiteSpace(s))
      return double.TryParse(s, NumberStyles.Float, CultureInfo.InvariantCulture, out result);

    return false;
  }

  static List<double> TryGetDoubleList(object input)
  {
    if (input == null) return null;

    var result = new List<double>();

    GH_Structure<IGH_Goo> tree = input as GH_Structure<IGH_Goo>;
    if (tree != null)
    {
      foreach (IGH_Goo goo in tree.AllData(true))
      {
        double d;
        if (TryGetDouble(goo, out d))
          result.Add(d);
      }
      return result.Count > 0 ? result : null;
    }

    IEnumerable enumerable = input as IEnumerable;
    if (enumerable != null && !(input is string))
    {
      foreach (object item in enumerable)
      {
        double d;
        if (TryGetDouble(item, out d))
          result.Add(d);
      }
      return result.Count > 0 ? result : null;
    }

    double one;
    if (TryGetDouble(input, out one))
      result.Add(one);

    return result.Count > 0 ? result : null;
  }

  static string NumberLabel(string start, int offset)
  {
    int n;
    if (!int.TryParse(start, out n))
      n = 1;
    return (n + offset).ToString();
  }

  static readonly List<string> ValidLetters = new List<string>()
  {
    "A","B","C","D","E","F","G","H","J","K","L","M","N","P","Q","R","S","T","U","V","W","X","Y"
  };

  static string LetterLabel(string start, int offset)
  {
    string s = string.IsNullOrWhiteSpace(start) ? "A" : start.ToUpperInvariant();
    int startIndex = ValidLetters.IndexOf(s);
    if (startIndex < 0) startIndex = 0;

    int index = startIndex + offset;
    if (index < ValidLetters.Count) return ValidLetters[index];

    int a = index / ValidLetters.Count - 1;
    int b = index % ValidLetters.Count;
    return ValidLetters[a % ValidLetters.Count] + ValidLetters[b];
  }

  static string FormatDouble(double value)
  {
    return value.ToString("G10", CultureInfo.InvariantCulture);
  }

    public override BoundingBox ClippingBox => BoundingBox.Empty;

    public override void DrawViewportMeshes(IGH_PreviewArgs args)
    {
    }

    public override void DrawViewportWires(IGH_PreviewArgs args)
    {
    }

    public override void BeforeRunScript()
    {
    }

    public override void AfterRunScript()
    {
    }
}

public class GridOptions
{
  public double AngleDeg;
  public double BubbleRadius;
  public double TextHeight;
  public double DimensionTextHeight;
  public double LeaderLength;
  public double AxisExtension;
  public double DimOffsetInner;
  public double DimOffsetOuter;
  public double ModelSpaceScale;
}

public class GridAxis
{
  public int Index;
  public double Station;
  public string Label;
  public Vector3d Direction;
  public Vector3d OffsetDirection;
  public Line Reference;
  public Line Extended;

  public Point3d GetSidePoint(int side)
  {
    Point3d center = Extended.PointAt(0.5);

    double a = Vector3d.Multiply(Extended.From - center, Direction);
    double b = Vector3d.Multiply(Extended.To - center, Direction);

    if (side >= 0)
      return a >= b ? Extended.From : Extended.To;

    return a <= b ? Extended.From : Extended.To;
  }
}

public class AxisGridResult
{
  public List<Curve> AxisLines = new List<Curve>();
  public List<Curve> AxisBubbleCurves = new List<Curve>();
  public List<TextEntity> AxisBubbleTexts = new List<TextEntity>();
  // 注意：AxisDimensions 已从结果类移出，现在直接由 RunScript 输出 DataTree
}

public static class AnnotationFactory
{
  public static TextEntity CreateText(string content, Plane plane, double height, DimensionStyle dimStyle, double modelSpaceScale)
  {
    TextEntity text = null;

    foreach (MethodInfo method in typeof(TextEntity).GetMethods(BindingFlags.Public | BindingFlags.Static))
    {
      if (method.Name != "Create") continue;

      ParameterInfo[] ps = method.GetParameters();
      object[] args = new object[ps.Length];
      bool ok = true;
      int doubles = 0;

      for (int i = 0; i < ps.Length; i++)
      {
        Type t = ps[i].ParameterType;
        if (t == typeof(string)) args[i] = content;
        else if (t == typeof(Plane)) args[i] = plane;
        else if (t == typeof(DimensionStyle)) args[i] = dimStyle;
        else if (t == typeof(bool)) args[i] = false;
        else if (t == typeof(double)) args[i] = doubles++ == 0 ? height : 0.0;
        else ok = false;
      }

      if (!ok) continue;

      try
      {
        text = method.Invoke(null, args) as TextEntity;
        if (text != null) break;
      }
      catch { }
    }

    if (text == null)
    {
      try { text = new TextEntity(); }
      catch { return null; }
    }

    TrySet(text, "Plane", plane);
    TrySet(text, "TextHeight", height);
    TrySet(text, "PlainText", content);
    TrySet(text, "Text", content);
    TrySet(text, "RichText", content);
    TrySet(text, "DimensionScale", modelSpaceScale);
    TryBindDimensionStyle(text, dimStyle);

    PropertyInfo just = typeof(TextEntity).GetProperty("Justification");
    if (just != null && just.CanWrite && just.PropertyType.IsEnum)
    {
      try { just.SetValue(text, Enum.Parse(just.PropertyType, "MiddleCenter"), null); }
      catch { }
    }

    return text;
  }

  public static LinearDimension CreateAlignedDimension(
    Point3d p1,
    Point3d p2,
    Point3d dimPoint,
    Vector3d dimDirection,
    Vector3d outsideDirection,
    DimensionStyle dimStyle,
    double textHeight,
    double modelSpaceScale)
  {
    if (!dimDirection.Unitize()) return null;
    if (!outsideDirection.Unitize()) return null;
    if (Math.Abs(Vector3d.Multiply(dimDirection, outsideDirection)) > 0.999) return null;

    Plane dimPlane = new Plane(dimPoint, dimDirection, outsideDirection);

    LinearDimension dim = null;
    try
    {
      dim = LinearDimension.Create(
        AnnotationType.Aligned,
        dimStyle,
        dimPlane,
        dimDirection,
        p1,
        p2,
        dimPoint,
        0.0);
    }
    catch
    {
      dim = null;
    }

    if (dim != null)
    {
      TrySet(dim, "TextHeight", textHeight);
      TrySet(dim, "DimensionScale", modelSpaceScale);
      TrySet(dim, "DrawForward", true);
      TryBindDimensionStyle(dim, dimStyle);
    }

    return dim;
  }

  static void TryBindDimensionStyle(object target, DimensionStyle dimStyle)
  {
    if (target == null || dimStyle == null) return;
    PropertyInfo p = target.GetType().GetProperty("DimensionStyleId");
    if (p == null || !p.CanWrite || p.PropertyType != typeof(Guid)) return;
    try { p.SetValue(target, dimStyle.Id, null); }
    catch { }
  }

  static void TrySet(object target, string propertyName, object value)
  {
    if (target == null) return;
    PropertyInfo p = target.GetType().GetProperty(propertyName);
    if (p == null || !p.CanWrite) return;
    try { p.SetValue(target, value, null); }
    catch { }
  }
}
# ---------- end axis ----------
