# Grasshopper definition 01 axis.gh (Grasshopper 1.0.8)

轴线外伸_mm = Slider(800, range=0..3000)
x轴间距_mm = Slider(8100, range=1000..30000)
y轴间距_mm = Slider(8400, range=1000..30000)
x轴号起始 = Slider(1, range=0..10)
y轴号起始 = Slider(1, range=0..10)
x跨数 = Slider(3, range=1..20)
y跨数 = Slider(4, range=1..20)
axis_grid = CSharpScript(xSpans=x轴间距_mm, ySpans=y轴间距_mm, xLabels=x轴号起始, yLabels=y轴号起始, extension=轴线外伸_mm, xCount=x跨数, yCount=y跨数)  # -> out, reportOut, axisLinesOut
# ---------- axis_grid: C# ----------
// Grasshopper Script Instance
#region Usings
using System;
using System.Linq;
using System.Collections;
using System.Collections.Generic;
using System.Drawing;
using Rhino;
using Rhino.Geometry;
using Grasshopper;
using Grasshopper.Kernel;
using Grasshopper.Kernel.Data;
using Grasshopper.Kernel.Types;
#endregion
public class Script_Instance : GH_ScriptInstance
{
    #region Notes
    /* 
      Members:
        RhinoDoc RhinoDocument
        GH_Document GrasshopperDocument
        IGH_Component Component
        int Iteration
      Methods (Virtual & overridable):
        Print(string text)
        Print(string format, params object[] args)
        Reflect(object obj)
        Reflect(object obj, string method_name)
    */
    #endregion
    private void RunScript(
		object xSpans,
		object ySpans,
		object xLabels,
		object yLabels,
		object extension,
		object xCount,
		object yCount,
		ref object reportOut,
		ref object axisLinesOut)
    {
        string xSpansStr = xSpans == null ? string.Empty : xSpans.ToString();
        string ySpansStr = ySpans == null ? string.Empty : ySpans.ToString();
        string xLabelsStr = xLabels == null ? string.Empty : xLabels.ToString();
        string yLabelsStr = yLabels == null ? string.Empty : yLabels.ToString();
        double ext = ToDoubleOrDefault(extension, 0.0);
        int xCnt = ToIntOrDefault(xCount, 1);
        int yCnt = ToIntOrDefault(yCount, 1);
        xCnt = Math.Max(1, Math.Min(20, xCnt));
        yCnt = Math.Max(1, Math.Min(20, yCnt));
        List<double> ParseNumbers(string raw)
        {
            var vals = new List<double>();
            if (string.IsNullOrWhiteSpace(raw)) return vals;
            var parts = raw.Split(new char[] { ',', ';', ' ' }, StringSplitOptions.RemoveEmptyEntries);
            foreach (var p in parts)
            {
                double v;
                if (double.TryParse(p, out v) && v > 0.0) vals.Add(v);
            }
            return vals;
        }
        List<string> ParseLabels(string raw)
        {
            var vals = new List<string>();
            if (string.IsNullOrWhiteSpace(raw)) return vals;
            var parts = raw.Split(new char[] { ',', ';', ' ' }, StringSplitOptions.RemoveEmptyEntries);
            foreach (var p in parts)
            {
                var s = p.Trim();
                if (!string.IsNullOrWhiteSpace(s)) vals.Add(s);
            }
            return vals;
        }
        double ToDoubleOrDefault(object value, double fallback)
        {
            if (value == null) return fallback;
            double parsed;
            return double.TryParse(value.ToString(), System.Globalization.NumberStyles.Float, System.Globalization.CultureInfo.InvariantCulture, out parsed) ? parsed : fallback;
        }
        int ToIntOrDefault(object value, int fallback)
        {
            if (value == null) return fallback;
            int parsed;
            return int.TryParse(value.ToString(), out parsed) ? parsed : fallback;
        }
        var xSpanValues = ParseNumbers(xSpansStr);
        var ySpanValues = ParseNumbers(ySpansStr);
        var xLabelValues = ParseLabels(xLabelsStr);
        var yLabelValues = ParseLabels(yLabelsStr);
        if (xSpanValues.Count == 1 && xCnt > 1)
        {
            double v = xSpanValues[0];
            xSpanValues = Enumerable.Repeat(v, xCnt).ToList();
        }
        if (ySpanValues.Count == 1 && yCnt > 1)
        {
            double v = ySpanValues[0];
            ySpanValues = Enumerable.Repeat(v, yCnt).ToList();
        }
        ext = Math.Max(0.0, ext);
        var report = new List<string>();
        var axisLines = new List<Line>();
        if (xSpanValues.Count == 0 || ySpanValues.Count == 0)
        {
            report.Add("xSpans 和 ySpans 不能为空。");
            reportOut = string.Join("\n", report);
            axisLinesOut = axisLines;
            return;
        }
        var xCoords = new List<double>();
        xCoords.Add(0.0);
        var yCoords = new List<double>();
        yCoords.Add(0.0);
        for (int i = 0; i < xSpanValues.Count; i++) xCoords.Add(xCoords[i] + xSpanValues[i]);
        for (int i = 0; i < ySpanValues.Count; i++) yCoords.Add(yCoords[i] + ySpanValues[i]);
        double totalX = xCoords[xCoords.Count - 1];
        double totalY = yCoords[yCoords.Count - 1];
        for (int i = 0; i < yCoords.Count; i++)
            axisLines.Add(new Line(new Point3d(-ext, yCoords[i], 0), new Point3d(totalX + ext, yCoords[i], 0)));
        for (int i = 0; i < xCoords.Count; i++)
            axisLines.Add(new Line(new Point3d(xCoords[i], -ext, 0), new Point3d(xCoords[i], totalY + ext, 0)));
        if (xLabelValues.Count > 0 && xLabelValues.Count != xCoords.Count)
            report.Add("xLabels 数量与 X 轴线数量不匹配。");
        if (yLabelValues.Count > 0 && yLabelValues.Count != yCoords.Count)
            report.Add("yLabels 数量与 Y 轴线数量不匹配。");
        report.Add("X轴跨数: " + xSpanValues.Count);
        report.Add("Y轴跨数: " + ySpanValues.Count);
        report.Add("总宽: " + totalX);
        report.Add("总高: " + totalY);
        report.Add("轴线: " + axisLines.Count);
        reportOut = string.Join("\n", report);
        axisLinesOut = axisLines;
    }
}
# ---------- end axis_grid ----------
