# Grasshopper definition 03 axis number.gh (Grasshopper 1.0.8)

轴号偏移_mm = Slider(5000, range=1000..12000)
x轴间距_mm = Slider(8100, range=1000..30000)
y轴间距_mm = Slider(8400, range=1000..30000)
轴线外伸_mm = Slider(800, range=0..3000)
轴号字高_mm = Slider(600, range=150..1600)
出图比例_1 = Slider(200, range=50..500)
x轴号起始 = Slider(1, range=0..10)
y轴号起始 = Slider(1, range=0..10)
x跨数 = Slider(3, range=1..20)
y跨数 = Slider(4, range=1..20)
axis_labels = CSharpScript(
    xSpans=x轴间距_mm,
    ySpans=y轴间距_mm,
    xLabels=x轴号起始,
    yLabels=y轴号起始,
    extension=轴线外伸_mm,
    labelOffset=轴号偏移_mm,
    axisTextHeight=轴号字高_mm,
    xCount=x跨数,
    yCount=y跨数,
    drawingScale=出图比例_1)  # -> out, axisLabelCirclesOut, axisLabelTextsOut, leaderLinesOut, reportOut
# ---------- axis_labels: C# ----------
// Grasshopper Script Instance
#region Usings
using System;
using System.Linq;
using System.Collections;
using System.Collections.Generic;
using System.Drawing;

using Rhino;
using Rhino.Geometry;

using Grasshopper;
using Grasshopper.Kernel;
using Grasshopper.Kernel.Data;
using Grasshopper.Kernel.Types;
#endregion

public class Script_Instance : GH_ScriptInstance
{
    #region Notes
    /* 
      Members:
        RhinoDoc RhinoDocument
        GH_Document GrasshopperDocument
        IGH_Component Component
        int Iteration

      Methods (Virtual & overridable):
        Print(string text)
        Print(string format, params object[] args)
        Reflect(object obj)
        Reflect(object obj, string method_name)
    */
    #endregion

    private void RunScript(
		object xSpans,
		object ySpans,
		object xLabels,
		object yLabels,
		object extension,
		object labelOffset,
		object axisTextHeight,
		object xCount,
		object yCount,
		object drawingScale,
		ref object axisLabelCirclesOut,
		ref object axisLabelTextsOut,
		ref object leaderLinesOut,
		ref object reportOut)
    {
    double ToDoubleOrDefault(object value, double fallback)
    {
      if (value == null) return fallback;
      double parsed;
      return double.TryParse(value.ToString(), System.Globalization.NumberStyles.Float, System.Globalization.CultureInfo.InvariantCulture, out parsed) ? parsed : fallback;
    }
    
    int ToIntOrDefault(object value, int fallback)
    {
      if (value == null) return fallback;
      int parsed;
      return int.TryParse(value.ToString(), out parsed) ? parsed : fallback;
    }
    
    string xSpansStr = xSpans == null ? string.Empty : xSpans.ToString();
    string ySpansStr = ySpans == null ? string.Empty : ySpans.ToString();
    string xLabelsStr = xLabels == null ? string.Empty : xLabels.ToString();
    string yLabelsStr = yLabels == null ? string.Empty : yLabels.ToString();
    double ext = ToDoubleOrDefault(extension, 0.0);
    double lblOff = ToDoubleOrDefault(labelOffset, 3600.0);
    double axisH = ToDoubleOrDefault(axisTextHeight, 600.0);
    int xCnt = ToIntOrDefault(xCount, 1);
    int yCnt = ToIntOrDefault(yCount, 1);
    double scale = ToDoubleOrDefault(drawingScale, 100.0);
    scale = Math.Max(10.0, Math.Min(1000.0, scale));
    double scaleFactor = scale / 100.0;
    xCnt = Math.Max(1, Math.Min(20, xCnt));
    yCnt = Math.Max(1, Math.Min(20, yCnt));
    
    List<double> ParseNumbers(string raw)
    {
      var vals = new List<double>();
      if (string.IsNullOrWhiteSpace(raw)) return vals;
      var parts = raw.Split(new char[] {',', ';', ' '}, StringSplitOptions.RemoveEmptyEntries);
      foreach (var p in parts) { double v; if (double.TryParse(p, out v) && v > 0.0) vals.Add(v); }
      return vals;
    }
    
    List<string> ParseLabels(string raw)
    {
      var vals = new List<string>();
      if (string.IsNullOrWhiteSpace(raw)) return vals;
      var parts = raw.Split(new char[] {',', ';', ' '}, StringSplitOptions.RemoveEmptyEntries);
      foreach (var p in parts) { var s = p.Trim(); if (!string.IsNullOrWhiteSpace(s)) vals.Add(s); }
      return vals;
    }
    
    TextEntity MakeText(string text, Plane plane, double height, TextJustification just)
    {
      var te = new TextEntity();
      te.Plane = plane; te.PlainText = text;
      te.TextHeight = height / scaleFactor;
      te.DimensionScale = scaleFactor;
      te.Justification = just;
      return te;
    }
    
    var xSpanValues = ParseNumbers(xSpansStr);
    var ySpanValues = ParseNumbers(ySpansStr);
    
    if (xSpanValues.Count == 1 && xCnt > 1) { double v = xSpanValues[0]; xSpanValues = Enumerable.Repeat(v, xCnt).ToList(); }
    if (ySpanValues.Count == 1 && yCnt > 1) { double v = ySpanValues[0]; ySpanValues = Enumerable.Repeat(v, yCnt).ToList(); }
    
    var xLabelValues = ParseLabels(xLabelsStr);
    var yLabelValues = ParseLabels(yLabelsStr);
    
    var report = new List<string>();
    var labelCircles = new List<Circle>();
    var labelTexts = new List<TextEntity>();
    var leaderLines = new List<Line>();
    
    if (xSpanValues.Count == 0 || ySpanValues.Count == 0)
    {
      report.Add("xSpans 和 ySpans 不能为空。");
      axisLabelCirclesOut = labelCircles; axisLabelTextsOut = labelTexts; leaderLinesOut = leaderLines;
      reportOut = string.Join("\n", report); return;
    }
    
    if (xLabelValues.Count != xSpanValues.Count + 1)
    {
      xLabelValues = new List<string>();
      for (int i = 0; i <= xSpanValues.Count; i++) xLabelValues.Add((i + 1).ToString());
      report.Add("xLabels 数量不匹配，已自动使用 1,2,3... 轴号。");
    }
    
    if (yLabelValues.Count != ySpanValues.Count + 1)
    {
      yLabelValues = new List<string>();
      for (int i = 0; i <= ySpanValues.Count; i++) yLabelValues.Add(((char)('A' + i)).ToString());
      report.Add("yLabels 数量不匹配，已自动使用 A,B,C... 轴号。");
    }
    
    ext = Math.Max(0.0, ext);
    lblOff = Math.Max(500.0, lblOff);
    axisH = Math.Max(50.0, axisH);
    
    var xCoords = new List<double>(); xCoords.Add(0.0);
    var yCoords = new List<double>(); yCoords.Add(0.0);
    for (int i = 0; i < xSpanValues.Count; i++) xCoords.Add(xCoords[i] + xSpanValues[i]);
    for (int i = 0; i < ySpanValues.Count; i++) yCoords.Add(yCoords[i] + ySpanValues[i]);
    double totalX = xCoords[xCoords.Count - 1];
    double totalY = yCoords[yCoords.Count - 1];
    
    double circleR = axisH * 1.2;
    double leaderStartGap = lblOff * 0.35;
    
    for (int i = 0; i < xCoords.Count; i++)
    {
      double xx = xCoords[i]; string label = xLabelValues[i];
      Point3d bc = new Point3d(xx, -(lblOff + ext), 0);
      Point3d tc = new Point3d(xx, totalY + lblOff + ext, 0);
      labelCircles.Add(new Circle(Plane.WorldXY, bc, circleR));
      labelCircles.Add(new Circle(Plane.WorldXY, tc, circleR));
      Plane pb = Plane.WorldXY; pb.Origin = bc;
      Plane pt = Plane.WorldXY; pt.Origin = tc;
      labelTexts.Add(MakeText(label, pb, axisH, TextJustification.MiddleCenter));
      labelTexts.Add(MakeText(label, pt, axisH, TextJustification.MiddleCenter));
      leaderLines.Add(new Line(new Point3d(xx, -(leaderStartGap + ext), 0), new Point3d(xx, -(lblOff + ext - circleR), 0)));
      leaderLines.Add(new Line(new Point3d(xx, totalY + leaderStartGap + ext, 0), new Point3d(xx, totalY + lblOff + ext - circleR, 0)));
    }
    
    for (int i = 0; i < yCoords.Count; i++)
    {
      double yy = yCoords[i]; string label = yLabelValues[i];
      Point3d lc = new Point3d(-(lblOff + ext), yy, 0);
      Point3d rc = new Point3d(totalX + lblOff + ext, yy, 0);
      labelCircles.Add(new Circle(Plane.WorldXY, lc, circleR));
      labelCircles.Add(new Circle(Plane.WorldXY, rc, circleR));
      Plane pl = Plane.WorldXY; pl.Origin = lc;
      Plane pr = Plane.WorldXY; pr.Origin = rc;
      labelTexts.Add(MakeText(label, pl, axisH, TextJustification.MiddleCenter));
      labelTexts.Add(MakeText(label, pr, axisH, TextJustification.MiddleCenter));
      leaderLines.Add(new Line(new Point3d(-(leaderStartGap + ext), yy, 0), new Point3d(-(lblOff + ext - circleR), yy, 0)));
      leaderLines.Add(new Line(new Point3d(totalX + leaderStartGap + ext, yy, 0), new Point3d(totalX + lblOff + ext - circleR, yy, 0)));
    }
    
    report.Add("出图比例: 1:" + ((int)scale));
    report.Add("单位: mm");
    report.Add("X轴跨数: " + xSpanValues.Count);
    report.Add("Y轴跨数: " + ySpanValues.Count);
    report.Add("总宽: " + (totalX.ToString()));
    report.Add("总高: " + (totalY.ToString()));
    report.Add("轴号圆: " + labelCircles.Count);
    report.Add("轴号文字: " + labelTexts.Count);
    report.Add("引线: " + leaderLines.Count);
    
    axisLabelCirclesOut = labelCircles; axisLabelTextsOut = labelTexts; leaderLinesOut = leaderLines;
    reportOut = string.Join("\n", report);
}
}
# ---------- end axis_labels ----------
